# Grasshopper definition panels_ex_01.gh (Grasshopper 1.0.7)

panel = Panel("""a
b
c""")
curve = Curve(<curve referenced from the Rhino model>)
concatenate = Concatenate(FragmentA=panel, FragmentB="b")
divide_curve = DivideCurve(Curve=curve, Count=Slider(10, range=0..20), Kinks=False)  # -> Points, Tangents, Parameters
panel_2 = Panel(concatenate)
panel_3 = Panel(divide_curve.Points)
panel_4 = Panel(divide_curve.Tangents)
panel_5 = Panel(divide_curve.Parameters)
