# Grasshopper definition atractors_example.gh (Grasshopper 1.0.7)

plane_surface = PlaneSurface(Plane=PlaneXY(0, 0, 0), XSize=Domain(-10, 10), YSize=Domain(-10, 10))
populate_geometry = PopulateGeometry(Geometry=plane_surface, Count=Slider(50, range=1..50), Seed=Slider(1, range=1..50))

md_slider = MDSlider(
    SliderMode=0,
    slider_value=Point(0.7759376868, 0.6687828622, 0.5),
    x_domain=Domain(0, 1),
    y_domain=Domain(0, 1),
    z_domain=Domain(0, 1))
evaluate_surface = EvaluateSurface(Surface=reparameterize(plane_surface), Point=md_slider)  # -> Point, Normal, UDirection, VDirection, Frame
circle = Circle(Plane=evaluate_surface.Frame, Radius=Slider(5.34, range=0..10))  # -> graft(Circle)
region_intersection = RegionIntersection(CurvesA=plane_surface, CurvesB=circle)
surface = Surface(region_intersection)
populate_geometry_2 = PopulateGeometry(Geometry=surface, Count=Slider(47, range=1..50), Seed=1)

merge = Merge(Data1=populate_geometry, Data2=populate_geometry_2)  # -> flatten(Result)
voronoi = Voronoi(Points=merge, Boundary=plane_surface, BruteForceOverride=False)

area = Area(Geometry=voronoi)  # -> Area, Centroid
scale = Scale(Geometry=voronoi, Center=area.Centroid, Factor=Slider(0.378, range=0.001..0.5))  # -> Geometry, Transform

curve = Curve(<curve referenced from the Rhino model>)
curve_closest_point = CurveClosestPoint(Point=area.Centroid, Curve=curve)  # -> Point, Parameter, Distance
bounds = Bounds(Numbers=curve_closest_point.Distance)
construct_domain = ConstructDomain(DomainStart=Slider(0.78, range=0..3), DomainEnd=Slider(1.9, range=0..3))
remap_numbers = RemapNumbers(Value=curve_closest_point.Distance, Source=bounds, Target=construct_domain)  # -> Mapped, Clipped
unit_z = UnitZ(Factor=remap_numbers.Mapped)
move = Move(Geometry=scale.Geometry, Motion=unit_z)  # -> Geometry, Transform

weave = Weave(Pattern=[0, 1], Stream0=graft(voronoi), Stream1=graft(move.Geometry), NullGaps=False)
weave_2 = Weave(Pattern=[0, 1], Stream0=graft(scale.Geometry), Stream1=graft(voronoi), NullGaps=False)
weave_3 = Weave(Pattern=[0, 1], Stream0=graft(scale.Geometry), Stream1=graft(move.Geometry), NullGaps=False)
panel = Panel(weave)
loft = Loft(Curves=weave, Options={Adjust=False, Closed=False, LoftEnds=0, LoftSimp=0, LoftType=0, Rebuild=10, Refit=0.01})
loft_2 = Loft(Curves=weave_2, Options={Adjust=False, Closed=False, LoftEnds=0, LoftSimp=0, LoftType=0, Rebuild=10, Refit=0.01})
loft_3 = Loft(Curves=weave_3, Options={Adjust=False, Closed=False, LoftEnds=0, LoftSimp=0, LoftType=0, Rebuild=10, Refit=0.01})
brep_join = BrepJoin(Breps=[loft, loft_2, loft_3])  # -> Breps, Closed
