# Grasshopper definition trelica-2023.gh (Grasshopper 1.0.7)

number_slider = Slider(9, range=0..100)
curve = Curve(<curve referenced from the Rhino model>)

unit_z = UnitZ(Factor=Slider(10, range=0..10))
move = Move(Geometry=curve, Motion=unit_z)  # -> Geometry, Transform

pipe = Pipe(Curve=[move.Geometry, curve], Radius=Slider(0.73, range=0..1), Caps=0)

divide_curve = DivideCurve(Curve=move.Geometry, Count=number_slider, Kinks=False)  # -> Points, Tangents, Parameters
divide_curve_2 = DivideCurve(Curve=curve, Count=number_slider, Kinks=False)  # -> Points, Tangents, Parameters

number_slider_2 = Slider(0.34, range=0..1)

dispatch = Dispatch(List=divide_curve.Points, DispatchPattern=[True, False])  # -> ListA, ListB
dispatch_2 = Dispatch(List=divide_curve_2.Points, DispatchPattern=[True, False])  # -> ListA, ListB
weave = Weave(Pattern=[0, 1], Stream0=dispatch.ListA, Stream1=dispatch_2.ListB, NullGaps=False)
weave_2 = Weave(Pattern=[0, 1], Stream0=dispatch_2.ListA, Stream1=dispatch.ListB, NullGaps=False)

polyline = PolyLine(Vertices=weave, Closed=False)
polyline_2 = PolyLine(Vertices=weave_2, Closed=False)
line = Line(StartPoint=divide_curve_2.Points, EndPoint=divide_curve.Points)

pipe_2 = Pipe(Curve=line, Radius=number_slider_2, Caps=0)
pipe_3 = Pipe(Curve=polyline, Radius=number_slider_2, Caps=0)
pipe_4 = Pipe(Curve=polyline_2, Radius=number_slider_2, Caps=0)
