# Grasshopper definition varandas_alernadas.gh (Grasshopper 1.0.7)

surface = Surface(<surface referenced from the Rhino model>)
divide_surface = DivideSurface(Surface=surface, UCount=Slider(10, range=0..100), VCount=Slider(10, range=0..100))  # -> Points, Normals, Parameters
point = Point(divide_surface.Points)
vector = Vector(divide_surface.Normals)
flip_matrix = FlipMatrix(Data=vector)
flip_matrix_2 = FlipMatrix(Data=point)
dispatch = Dispatch(List=point, DispatchPattern=[True, False])  # -> ListA, ListB
shift_list = ShiftList(List=point, Shift=1, Wrap=Toggle(False))

# ---- group: Lista Final
shift_list_2 = ShiftList(List=flip_matrix_2, Shift=1, Wrap=False)
list_item = ListItem(List=reverse(shift_list_2), Index=0, Wrap=True)
dispatch_2 = Dispatch(List=shift_list_2, DispatchPattern=[True, False])  # -> ListA, ListB
tree_statistics = TreeStatistics(Tree=shift_list_2)  # -> Paths, Length, Count
merge = Merge(Data1=dispatch_2.ListA, Data2=list_item)
merge_2 = Merge(Data1=dispatch_2.ListB, Data2=list_item)
dispatch_3 = Dispatch(List=tree_statistics.Paths, DispatchPattern=[True, False])  # -> ListA, ListB
tree_branch = TreeBranch(Tree=merge_2, Path=dispatch_3.ListA, MaintainPaths=True)
tree_branch_2 = TreeBranch(Tree=merge, Path=dispatch_3.ListB, MaintainPaths=True)
merge_3 = Merge(Data1=tree_branch_2, Data2=tree_branch)

# ----
amplitude = Amplitude(Vector=flip_matrix, Amplitude=Slider(10, range=0..10))
move = Move(Geometry=point, Motion=amplitude)  # -> Geometry, Transform
dispatch_4 = Dispatch(List=move.Geometry, DispatchPattern=[True, False])  # -> ListA, ListB

dispatch_5 = Dispatch(List=flip_matrix_2, DispatchPattern=[True, False])  # -> ListA, ListB
list_item_2 = ListItem(List=flip_matrix_2, Index=0, Wrap=True)
merge_4 = Merge(Data1=list_item_2, Data2=dispatch_5.ListB)
tree_statistics_2 = TreeStatistics(Tree=flip_matrix_2)  # -> Paths, Length, Count
dispatch_6 = Dispatch(List=tree_statistics_2.Paths, DispatchPattern=[True, False])  # -> ListA, ListB
tree_branch_3 = TreeBranch(Tree=merge_4, Path=dispatch_6.ListB, MaintainPaths=True)
tree_branch_4 = TreeBranch(Tree=dispatch_5.ListA, Path=dispatch_6.ListA, MaintainPaths=True)
merge_5 = Merge(Data1=tree_branch_4, Data2=tree_branch_3)

dispatch_7 = Dispatch(List=shift_list, DispatchPattern=[True, False])  # -> ListA, ListB
panel = Panel("""0
1
2""")
weave = Weave(Pattern=[0, 1], Stream0=dispatch_4.ListA, Stream1=dispatch.ListB, NullGaps=False)
weave_2 = Weave(Pattern=panel, Stream0=point, Stream1=move.Geometry, Stream2=shift_list, NullGaps=False)
move_2 = Move(Geometry=flip_matrix_2, Motion=amplitude)  # -> Geometry, Transform
polyline = PolyLine(Vertices=weave_2, Closed=True)
polyline_2 = PolyLine(Vertices=weave, Closed=True)

tree_statistics_3 = TreeStatistics(Tree=move_2.Geometry)  # -> Paths, Length, Count
dispatch_8 = Dispatch(List=tree_statistics_3.Paths, DispatchPattern=[True, False])  # -> ListA, ListB
dispatch_9 = Dispatch(List=move_2.Geometry, DispatchPattern=[True, False])  # -> ListA, ListB
tree_branch_5 = TreeBranch(Tree=dispatch_9.ListB, Path=dispatch_8.ListA, MaintainPaths=True)
tree_branch_6 = TreeBranch(Tree=dispatch_9.ListA, Path=dispatch_8.ListB, MaintainPaths=True)
merge_6 = Merge(Data1=tree_branch_5, Data2=tree_branch_6)

boundary_surfaces = BoundarySurfaces(Edges=polyline)
boundary_surfaces_2 = BoundarySurfaces(Edges=polyline_2)
shortest_list = ShortestList(ListListA=merge_5, ListListB=merge_6, ListA=merge_3, TrimMode=2)  # -> ListListA, ListListB, ListA
merge_7 = Merge(Data1=graft(shortest_list.ListListA), Data2=graft(shortest_list.ListListB), Data3=graft(shortest_list.ListA))
polyline_3 = PolyLine(Vertices=merge_7, Closed=Toggle(True))
boundary_surfaces_3 = BoundarySurfaces(Edges=polyline_3)
unit_z = UnitZ(Factor=Slider(-0.2, range=-0.2..0))
extrude = Extrude(Base=boundary_surfaces_3, Direction=unit_z)
