# Grasshopper definition voronoi_examples.gh (Grasshopper 1.0.7)

plane_surface = PlaneSurface(Plane=PlaneXY(0, 0, 0), XSize=Domain(-10, 10), YSize=Domain(-10, 10))
md_slider = MDSlider(
    SliderMode=0,
    slider_value=Point(0.3731399255, 0.5748467794, 0.5),
    x_domain=Domain(0, 1),
    y_domain=Domain(0, 1),
    z_domain=Domain(0, 1))
populate_geometry = PopulateGeometry(Geometry=plane_surface, Count=Slider(70, range=0..200), Seed=Slider(3, range=0..200))
evaluate_surface = EvaluateSurface(Surface=reparameterize(plane_surface), Point=md_slider)  # -> Point, Normal, UDirection, VDirection, Frame
circle = Circle(Plane=evaluate_surface.Frame, Radius=Slider(5.32, range=0..10))
region_intersection = RegionIntersection(CurvesA=plane_surface, CurvesB=circle)
curve = Curve(plane_surface)
boundary_surfaces = BoundarySurfaces(Edges=region_intersection)
populate_geometry_2 = PopulateGeometry(Geometry=boundary_surfaces, Count=Slider(47, range=0..100), Seed=1)
merge = Merge(Data1=populate_geometry, Data2=populate_geometry_2)
panel = Panel(region_intersection)
point = Point(flatten(merge))
voronoi = Voronoi(Points=point, Boundary=curve, BruteForceOverride=False)
area = Area(Geometry=voronoi)  # -> Area, Centroid
number_slider = Slider(0.65, range=0..2)
panel_2 = Panel(voronoi)
scale = Scale(Geometry=voronoi, Center=area.Centroid, Factor=Slider(0.41, range=0..1))  # -> Geometry, Transform
curve_2 = Curve(<curve referenced from the Rhino model>)
graft_tree = GraftTree(Tree=voronoi, IncludeEmptyLists=True, IncludeNullItems=True)
curve_closest_point = CurveClosestPoint(Point=area.Centroid, Curve=curve_2)  # -> Point, Parameter, Distance
fillet_distance = FilletDistance(Curve=scale.Geometry, Distance=Slider(0.5, range=0..1))
bounds = Bounds(Numbers=curve_closest_point.Distance)
construct_domain = ConstructDomain(DomainStart=Slider(1.32, range=0..2), DomainEnd=Slider(0.2, range=0..1))
remap_numbers = RemapNumbers(Value=curve_closest_point.Distance, Source=bounds, Target=construct_domain)  # -> Mapped, Clipped
unit_z = UnitZ(Factor=remap_numbers.Mapped)
move = Move(Geometry=scale.Geometry, Motion=unit_z)  # -> Geometry, Transform
merge_2 = Merge(Data1=graft_tree, Data2=graft(fillet_distance))
panel_3 = Panel(unit_z)
boundary_surfaces_2 = BoundarySurfaces(Edges=merge_2)  # -> flatten(Surfaces)
extrude = Extrude(Base=boundary_surfaces_2, Direction=unit_z)
panel_4 = Panel(boundary_surfaces_2)
