# Grasshopper definition brise_parametrico.gh (Grasshopper 1.0.7)

number_slider = Slider(16, range=0..100)
curve = Curve(<curve referenced from the Rhino model>)

# ---- group: Criação dos eixos dos montantes
divide_curve = DivideCurve(Curve=curve, Count=number_slider, Kinks=False)  # -> Points, Tangents, Parameters
unit_z = UnitZ(Factor=Slider(8.711, range=0..100))
point = Point(divide_curve.Points)
move = Move(Geometry=point, Motion=unit_z)  # -> Geometry, Transform
line = Line(StartPoint=point, EndPoint=move.Geometry)

# ----
panel = Panel(curve)
panel_2 = Panel(divide_curve.Points)
number_slider_2 = Slider(10, range=0..100)

# ---- group: Manipulação da lista de eixos de pilares
cull_index = CullIndex(List=line, Indices=number_slider, Wrap=True)
cull_index_2 = CullIndex(List=line, Indices="0", Wrap=True)

# ---- group: Eixos das aletas do brise
divide_curve_2 = DivideCurve(Curve=cull_index, Count=number_slider_2, Kinks=False)  # -> Points, Tangents, Parameters
divide_curve_3 = DivideCurve(Curve=cull_index_2, Count=number_slider_2, Kinks=False)  # -> Points, Tangents, Parameters
line_2 = Line(StartPoint=divide_curve_2.Points, EndPoint=divide_curve_3.Points)

# ---- group: Criação das aletas
construct_plane = ConstructPlane(Origin=divide_curve_2.Points, XAxis=line_2, YAxis=divide_curve_2.Tangents)
deconstruct_plane = DeconstructPlane(Plane=construct_plane)  # -> Origin, XAxis, YAxis, ZAxis
construct_plane_2 = ConstructPlane(Origin=deconstruct_plane.Origin, XAxis=deconstruct_plane.ZAxis, YAxis=deconstruct_plane.YAxis)
cluster_retangulo_eixo = ClusterRetanguloEixo(plane=construct_plane_2, angle=Slider(-30, range=-360..360), dim_x=Slider(0.39, range=0..1), dim=Slider(0.2, range=0..1))
extrude_along = ExtrudeAlong(Base=cluster_retangulo_eixo, Curve=line_2)
cap_holes = CapHoles(Brep=extrude_along)

# ---- group: trocando cores
colour_picker = ColourPicker(PickedColour=RGB(228, 231, 84))
create_material = CreateMaterial(Diffuse=colour_picker, Specular=RGB(255, 255, 255), Emission=RGB(0, 0, 0), Transparency=0, Shine=0)
custom_preview = CustomPreview(Geometry=cap_holes, Material=create_material)

# ==== cluster ClusterRetanguloEixo
plane = ClusterInput()
angle = ClusterInput()
dim_x = ClusterInput()
dim = ClusterInput()
rotate_plane = RotatePlane(Plane=plane, Angle=degrees(angle))
dim_x_2 = Number(dim_x)
dim_2 = Number(dim)
deconstruct_plane = DeconstructPlane(Plane=rotate_plane)  # -> Origin, XAxis, YAxis, ZAxis
division = Division(A=dim_2, B="-2")
division_2 = Division(A=dim_x_2, B="-2")
multiplication = Multiplication(A=deconstruct_plane.YAxis, B=division)
multiplication_2 = Multiplication(A=deconstruct_plane.XAxis, B=division_2)
addition = Addition(A=multiplication_2, B=multiplication)
move = Move(Geometry=rotate_plane, Motion=addition)  # -> Geometry, Transform
rectangle = Rectangle(Plane=move.Geometry, XSize=dim_x_2, YSize=dim_2, Radius=0)  # -> Rectangle, Length
rectangle_2 = ClusterOutput(rectangle.Rectangle)
