# Grasshopper definition TER_00_add_info_V00.gh (Grasshopper 1.0.7)
# plug-ins: EleFront, MetaHopper

colour_swatch = ColourSwatch(SwatchColor=RGB(255, 0, 247))

# ----
# 2 - Clique no botão abaixo para
# criar os Layers auxiliares Info::xxx
button = Button()

concatenate = Concatenate(FragmentA="Info::", FragmentB="limites_terreno")

# ----
# 1 - Abra o arquivo da base Sicar.
# Crie um layer chamado
# e coloque todos os layers importados
#  como sublayers do layer criado.
panel = Panel("Sicar")

define_layer_r6 = DefineLayerR6(Name=concatenate, Color=colour_swatch)
panel_2 = Panel(concatenate)
bake_modify_layer_r6 = BakeModifyLayerR6(Layer=define_layer_r6, Bake=button)
concatenate_2 = Concatenate(Fragment_A=panel, A="::", Fragment_B="*")
reference_by_layer_r6 = ReferenceByLayerR6(LayerName=concatenate_2, DisableAutoUpdate=False)
panel_3 = Panel(concatenate_2)

# ----
# 4 -Selecione um ponto por coordenadas
# para servir de referênca geogáfica
point = Point(Point(555800, 8561400, 0))

# ----
# 3 - desenhe a poligonal dos
# limites do terreno no Layer
# 
# em seguida, clique no botão update
panel_4 = Panel(define_layer_r6)
reference_by_layer_r6_2 = ReferenceByLayerR6(LayerName=concatenate, DisableAutoUpdate=False)

panel_5 = Panel(reference_by_layer_r6)

deconstruct = Deconstruct(Point=point)  # -> XComponent, YComponent, ZComponent
construct_point = ConstructPoint(XCoordinate=deconstruct.XComponent, YCoordinate=deconstruct.YComponent, ZCoordinate="0")
colour_swatch_2 = ColourSwatch(SwatchColor=RGB(192, 242, 191))
concatenate_3 = Concatenate(FragmentA="Info::", FragmentB="georref_point")
define_layer_r6_2 = DefineLayerR6(Name=concatenate_3, Color=colour_swatch_2)
merge = Merge(Data1="original_layer", Data2="layer_color", Data3="COORD_X", Data4="COORD_Y", Data5="georref_point")
merge_2 = Merge(
    Data1=concatenate_3,
    Data2=colour_swatch_2,
    Data3=deconstruct.XComponent,
    Data4=deconstruct.YComponent,
    Data5=Toggle(True))
define_object_attributes_r6 = DefineObjectAttributesR6(UserKeys=merge, UserValues=merge_2, Layer=define_layer_r6_2)

get_rhino_attributes_r6 = GetRhinoAttributesR6(Geometry=reference_by_layer_r6, readFullPath=True)  # -> Name, Layer, Color
merge_3 = Merge(Data1=graft(get_rhino_attributes_r6.Layer), Data2=graft(get_rhino_attributes_r6.Color))
merge_4 = Merge(Data1="original_layer", Data2="layer_color")
define_object_attributes_r6_2 = DefineObjectAttributesR6(UserKeys=merge_4, UserValues=merge_3, Layer=graft(get_rhino_attributes_r6.Layer))

bounding_box = BoundingBox(Content=reference_by_layer_r6, Plane=PlaneXY(0, 0, 0), UnionBox=True)  # -> Box, Box_2
deconstruct_box = DeconstructBox(Box=bounding_box.Box)  # -> Plane, X, Y, Z
deconstruct_domain = DeconstructDomain(Domain=deconstruct_box.Z)  # -> Start, End
subtraction = Subtraction(A=deconstruct_domain.End, B=deconstruct_domain.Start)
merge_5 = Merge(
    Data1="original_layer",
    Data2="layer_color",
    Data3="bbox_entorno",
    Data4="bbox_z_min",
    Data5="bbox_z_max",
    Data6="bbox_altura_total")
concatenate_4 = Concatenate(FragmentA="Info::", FragmentB="bbox_entorno")
colour_swatch_3 = ColourSwatch(SwatchColor=RGB(0, 125, 242))
define_layer_r6_3 = DefineLayerR6(Name=concatenate_4, Color=colour_swatch_3)
merge_6 = Merge(
    Data1=concatenate_4,
    Data2=colour_swatch_3,
    Data3=Toggle(True),
    Data4=deconstruct_domain.Start,
    Data5=deconstruct_domain.End,
    Data6=subtraction)  # -> flatten(Result)
define_object_attributes_r6_3 = DefineObjectAttributesR6(UserKeys=merge_5, UserValues=merge_6, Layer=define_layer_r6_3)

merge_7 = Merge(Data1="original_layer", Data2="layer_color", Data3="limites_terreno")
get_rhino_attributes_r6_2 = GetRhinoAttributesR6(Geometry=reference_by_layer_r6_2, readFullPath=True)  # -> Name, Layer, Color
suirify = Suirify(get_rhino_attributes_r6_2.Layer)
merge_8 = Merge(Data1=suirify, Data2=colour_swatch, Data3=Toggle(True))  # -> flatten(Result)
define_object_attributes_r6_4 = DefineObjectAttributesR6(UserKeys=merge_7, UserValues=merge_8, Layer=get_rhino_attributes_r6_2.Layer)

panel_6 = Panel(merge_7)
panel_7 = Panel(merge_5)
panel_8 = Panel(merge_4)
panel_9 = Panel(merge_3)
panel_10 = Panel(concatenate_4)
panel_11 = Panel(merge_8)
bake_modify_layer_r6_2 = BakeModifyLayerR6(Layer=define_layer_r6_3, Bake=button)
bake_modify_layer_r6_3 = BakeModifyLayerR6(Layer=define_layer_r6_2, Bake=button)
panel_12 = Panel(merge_6)
panel_13 = Panel(merge)

# ----
# 5 - Clique no botão abaixo
# para salvar as informações
# no arquivo
button_2 = Button()

# ----
# 6 - Clique nos botões Update e Activate
#  para exportar uma uma cópia
# da geometria e dos dados usando
# o ponto de eorreferenciamento
# corresponderá a origem do plano Word XY
panel_14 = Panel("*")
reference_by_layer_r6_3 = ReferenceByLayerR6(LayerName=panel_14, DisableAutoUpdate=False)
xy_plane = XYPlane(Origin=construct_point)
relative_path = RelativePath(Path=".\")
guid = Guid(reference_by_layer_r6_3)
export_objects_r6 = ExportObjectsR6(
    FolderPath=relative_path,
    FileName="TER_01_origin_V00",
    FileExtension=".3dm",
    RhinoObjects=guid,
    AxisSystem=xy_plane,
    Export=False)

modify_rhinoobject_attributes_r6 = ModifyRhinoObjectAttributesR6(Geometry=reference_by_layer_r6_2, Attributes=define_object_attributes_r6_4, Modify=button_2)
bake_objects_r6 = BakeObjectsR6(Geometry=bounding_box.Box, Attributes=define_object_attributes_r6_3, BakeName="bbox_entorno", Bake=button_2)
modify_rhinoobject_attributes_r6_2 = ModifyRhinoObjectAttributesR6(Geometry=graft(reference_by_layer_r6), Attributes=define_object_attributes_r6_2, Modify=button_2)
bake_objects_r6_2 = BakeObjectsR6(Geometry=construct_point, Attributes=define_object_attributes_r6, BakeName="georref_point", Bake=button_2)
