# Grasshopper definition TER_02_mov_de_terra_V00.gh (Grasshopper 1.0.7)
# plug-ins: EleFront, MetaHopper

panel = Panel("Aux::mov_terra::cv_srf::corte_aterro")
value_list = ValueList({"3D", "3D::mov_terra", "3D::mov_terra::cv_srf", "3D::mov_terra::cv_srf::aterro", "3D::mov_terra::cv_srf::corte", "3D::mov_terra::cv_srf::corte_aterro", "3D::mov_terra::solidos", "3D::mov_terra::solidos::aterro", "3D::mov_terra::solidos::corte", "3D::mov_terra::solidos::corte_aterro"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}, selected="3D::Terreno")
value_list_2 = ValueList({"3D", "3D::mov_terra", "3D::mov_terra::cv_srf", "3D::mov_terra::cv_srf::aterro", "3D::mov_terra::cv_srf::corte", "3D::mov_terra::cv_srf::corte_aterro", "3D::mov_terra::solidos", "3D::mov_terra::solidos::aterro", "3D::mov_terra::solidos::corte", "3D::mov_terra::solidos::corte_aterro"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}, selected="Info::bbox_entorno")
merge = Merge(Data1="Aux::mov_terra::cv_srf::corte", Data2=panel)
merge_2 = Merge(Data1="Aux::mov_terra::cv_srf::aterro", Data2=panel)
reference_by_layer_r6 = ReferenceByLayerR6(LayerName=merge_2, DisableAutoUpdate=False)  # -> graft(Geometry)
reference_by_layer_r6_2 = ReferenceByLayerR6(LayerName="Aux::mov_terra::solidos::corte", DisableAutoUpdate=False)
reference_by_layer_r6_3 = ReferenceByLayerR6(LayerName=value_list, DisableAutoUpdate=False)
reference_by_layer_r6_4 = ReferenceByLayerR6(LayerName=merge, DisableAutoUpdate=False)  # -> graft(Geometry)
reference_by_layer_r6_5 = ReferenceByLayerR6(LayerName="Aux::mov_terra::solidos::aterro", DisableAutoUpdate=False)
reference_by_layer_r6_6 = ReferenceByLayerR6(LayerName=value_list_2, DisableAutoUpdate=False)
group_toggle = GroupToggle(ToggleActive=True, ToggleVisible=False)  # disabled

button = Button()

panel_2 = Panel("""corte
aterro""")
concatenate = Concatenate(Fragment_A="Aux", Fragment_B="::", A="mov_terra")
concatenate_2 = Concatenate(Fragment_A=concatenate, Fragment_B="::", A=["cv_srf", "solidos"])
concatenate_3 = Concatenate(Fragment_A="3D", Fragment_B="::", A="terreno_mov_terra")
concatenate_4 = Concatenate(Fragment_A=graft(concatenate_2), Fragment_B="::", A=panel_2)
define_layer_r6 = DefineLayerR6(Name=concatenate, Color=ColourSwatch(SwatchColor=RGB(255, 255, 255)))
define_layer_r6_2 = DefineLayerR6(Name=concatenate_2, Color=ColourSwatch(SwatchColor=RGB(101, 54, 133)))
colour_swatch = ColourSwatch(SwatchColor=RGB(21, 237, 39))
define_layer_r6_3 = DefineLayerR6(Name=concatenate_3, Color=colour_swatch)
merge_3 = Merge(Data1=ColourSwatch(SwatchColor=RGB(158, 84, 120)), Data2=ColourSwatch(SwatchColor=RGB(204, 175, 57)))
define_layer_r6_4 = DefineLayerR6(Name=concatenate_4, Color=merge_3)
bake_modify_layer_r6 = BakeModifyLayerR6(Layer=define_layer_r6_3, Bake=button)
bake_modify_layer_r6_2 = BakeModifyLayerR6(Layer=define_layer_r6, Bake=button)
bake_modify_layer_r6_3 = BakeModifyLayerR6(Layer=define_layer_r6_4, Bake=button)
bake_modify_layer_r6_4 = BakeModifyLayerR6(Layer=define_layer_r6_2, Bake=button)

concatenate_5 = Concatenate(Fragment_A=graft(concatenate), Fragment_B="::", A="cv_srf", B="::", C="corte_aterro")
value_list_3 = ValueList({"bbox_altura_total", "bbox_entorno", "bbox_z_max", "bbox_z_min", "layer_color", "original_layer"}, selected="bbox_altura_total")
define_layer_r6_5 = DefineLayerR6(Name=concatenate_5, Color=ColourSwatch(SwatchColor=RGB(186, 207, 95)))
get_user_value_r6 = GetUserValueR6(Geometry=reference_by_layer_r6_6, Key=value_list_3)

surface = Surface(reference_by_layer_r6_4)
multiplication = Multiplication(A=get_user_value_r6, B=Slider(5, range=1..50))
unit_z = UnitZ(Factor=multiplication)
extrude = Extrude(Base=flatten(surface), Direction=unit_z)
merge_4 = Merge(Data1=extrude, Data2=reference_by_layer_r6_2)  # -> flatten(Result)
solid_difference = SolidDifference(BrepsA=reference_by_layer_r6_3, BrepsB=merge_4)

surface_2 = Surface(reference_by_layer_r6)
negative = Negative(Value=get_user_value_r6)
unit_z_2 = UnitZ(Factor=negative)
extrude_2 = Extrude(Base=surface_2, Direction=unit_z_2)
merge_5 = Merge(Data1=solid_difference, Data2=extrude_2, Data3=reference_by_layer_r6_5)
solid_union = SolidUnion(Breps=flatten(merge_5))

bake_modify_layer_r6_5 = BakeModifyLayerR6(Layer=define_layer_r6_5, Bake=button)
panel_3 = Panel(get_user_value_r6)
panel_4 = Panel(define_layer_r6_4)
panel_5 = Panel(concatenate_4)
panel_6 = Panel(concatenate_5)

# ---- group: Volumes de terra
solid_difference_2 = SolidDifference(BrepsA=reference_by_layer_r6_3, BrepsB=solid_union)  # disabled
solid_difference_3 = SolidDifference(BrepsA=solid_union, BrepsB=reference_by_layer_r6_3)  # disabled
volume = Volume(Geometry=solid_difference_2)  # -> Volume, Centroid; disabled
volume_2 = Volume(Geometry=solid_difference_3)  # -> Volume, Centroid; disabled
group_toggle_2 = GroupToggle(ToggleActive=True, ToggleVisible=False)  # disabled
mass_addition = MassAddition(Input=volume.Volume)  # -> Result, PartialResults; disabled
mass_addition_2 = MassAddition(Input=volume_2.Volume)  # -> Result, PartialResults; disabled
panel_7 = Panel(volume_2.Volume)  # disabled
panel_8 = Panel(volume.Volume)  # disabled
panel_9 = Panel(mass_addition.Result)  # disabled
panel_10 = Panel(mass_addition_2.Result)  # disabled

# ----
# Clique nos botões
# Update e Activate (nesta ordem)
#  para exportar
# uma uma cópia da
# geometria e dos dados
# para o arquivo
panel_11 = Panel("EP_00_base_V00")

suirify = Suirify(mass_addition.Result)
suirify_2 = Suirify(mass_addition_2.Result)
suirify_3 = Suirify("original_layer")
suirify_4 = Suirify(concatenate_3)
suirify_5 = Suirify("corte")
suirify_6 = Suirify(colour_swatch)
suirify_7 = Suirify("layer_color")
suirify_8 = Suirify("aterro")
merge_6 = Merge(Data1=suirify_5, Data2=suirify_8, Data3=suirify_3, Data4=suirify_7)
merge_7 = Merge(Data1=suirify, Data2=suirify_2, Data3=suirify_4, Data4=suirify_6)
define_object_attributes_r6 = DefineObjectAttributesR6(UserKeys=merge_6, UserValues=merge_7, Layer=define_layer_r6_3)

reference_by_layer_r6_7 = ReferenceByLayerR6(LayerName="*", DisableAutoUpdate=True)
relative_path = RelativePath(Path="..\EP\")
guid = Guid(reference_by_layer_r6_7)
export_objects_r6 = ExportObjectsR6(
    FolderPath=relative_path,
    FileName=panel_11,
    FileExtension=".3dm",
    RhinoObjects=guid,
    AxisSystem=PlaneXY(0, 0, 0),
    Export=False)

panel_12 = Panel(relative_path)
bake_objects_r6 = BakeObjectsR6(Geometry=solid_union, Attributes=define_object_attributes_r6, BakeName="terreno_mov_terra", Bake=Button())
