# Grasshopper definition Fase individual_Kyane Bomfim(v3).gh (Grasshopper 1.0.7)

# ---- group: RECUOS
# 2 - DEFINIR RECUOS PARA GERAR A VOLUMETRIA
# * Ex: Valor do metro quadrado coberto do primeiro pavimento: R$10.000,00/m²; Valor do metro quadrado coberto do segundo pavimento: 10.100,00/m²; Valor do metro quadrado coberto do terceiro pavimento: 10.201,00/m² [...]
# 
# * Ex: Valor do metro quadrado descoberto do primeiro pavimento: R$7.000,00/m²; Valor do metro quadrado coberto do segundo pavimento: 7.070,00/m²; Valor do metro quadrado coberto do terceiro pavimento: 7.140,70/m² [...]
genes = GenePool(Decimals=3, Maximum=0.53, Minimum=0.1, Value=[0.517, 0.307, 0.321, 0.159, 0.363, 0.264, 0.335, 0.415, 0.114, 0.41])

# ----
entrepiso_m = Panel("3")
# Maximização de Valor Geral de Venda (VGV) em um terreno hipotético
# CONDICIONANTES: * Dimensões do terreno: 30x50m;
# * Cada pavimento deve recuar o percentual de 10% (no mínimo) sobre a sua altura;
# * Índice construtivo: 4;
# * Entrepiso: 3m;
# 
# * Valor de metro quadrado da área coberta: R$10.000,00/m²;
# * Valor de metro quadrado da área descoberta: R$7.000,00/m²;
# 
# * Taxa de valorização do metro quadrado pela altura do pavimento: 1% por pavimento;
# 
# * Área descoberta não contabiliza como área construída;
# * Sacadas não serão consideradas;
# * Área descoberta considerada como terraço;
# * Não existe área mínima para cada pavimento;
# 1 - SELECIONAR TERRENO DE ESTUDO
índice_construtivo = Panel("4")
srf = Surface(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)
lng = ListLength(List=genes)
area = Area(Geometry=srf)  # -> Area, Centroid
neg = Negative(Value=genes)
área_do_terreno_m2 = Panel(area.Area)
series = Series(Start=0, Step=entrepiso_m, Count=lng)
offset = OffsetCurve(Curve=srf, Distance=neg, Plane=PlaneXY(0, 0, 0), Corners=1)
crv = Curve(<curve referenced from the Rhino model>)
Z = UnitZ(Factor=series)
multiplication = Multiplication(A=área_do_terreno_m2, B=índice_construtivo)
python = GhPythonScript(
    terreno=crv,
    indice_constru="4",
    pap="3",
    val_cob="10000",
    val_desc="7000",
    scale_fac=Slider(0.9, range=0..1),
    scale_fac_start=Slider(0.9, range=0..1),
    scale_count=Slider(4, range=0..10))  # -> out, tot_val_cob, tot_val_desc, tot_val, num_pav, area_cob_pav, area_cob_tot, Volumetria; inputs scale_count: Int32
# ---------- python: Python ----------
from __future__ import print_function

import rhinoscriptsyntax as rs

from Rhino.Geometry import Point3d


if scale_fac is None:
    scale_fac = .9

if scale_count is None:
    scale_count = 9

Volumetria =[]
# critério de parada
area_max = rs.Area(terreno) * indice_constru

# recuo inicial


# perimetro do pavimento
p_center = rs.CurveAreaCentroid(terreno)[0]
base_pav = terreno

area_cob_tot = 0
area_desc_total= 0
area_cob_pav = []
area_des_pav = []


def scaleList(start, end, count):
    increm = (end - start)/count
    slist = []
    for i in range(count):
        temp = i*increm + start
        slist.append(temp)
    return slist



slist = scaleList(scale_fac_start, scale_fac, scale_count)

print (slist)
    

num_pav = 0
cond = True
while (area_cob_tot < area_max) and (cond == True):
    # criando pavimento
    if num_pav < len(slist):
        j = num_pav
    else:
        j = len(slist) - 1
    base_pav = rs.ScaleObject(base_pav, p_center, [slist[j], slist[j], 1], True)
    base_pav_area = rs.Area(base_pav)
    if (base_pav_area + area_cob_tot) > area_max:
        print('pavimento ', num_pav +1, 'com área de ', base_pav_area, 'm².')
        over_area = (base_pav_area + area_cob_tot) - area_max
        print("Excede a área máxima em  ", over_area , 'm².')
        max_possible = area_max - area_cob_tot

        print("Àrea máxma possível para o pavimento: ", max_possible,  'm².')
        if max_possible>0:
            scale_max = (max_possible/base_pav_area)**.5
            base_pav = rs.ScaleObject(base_pav, p_center, [scale_max, scale_max, 1], True)
            base_pav_area = rs.Area(base_pav)
            cond = False
        
    # atuaizando área coberta
    area_cob_pav.append(base_pav_area)
    if num_pav > 0:
        base_pav = rs.MoveObject(base_pav, [0,0,pap])
    area_cob_tot += base_pav_area
    facePav = rs.AddPlanarSrf(base_pav)
    # - ponto auxxiliar para extrusão da face
    Paux = rs.PointAdd(p_center, [0,0,pap])
# linha auxiliar para a extrusão da face
    lAux = rs.AddLine(p_center, Paux)
# - extrusão da face - criação da laje
    try:
        pav = rs.ExtrudeSurface(facePav,lAux )
        Volumetria.append(pav)
    except:
        cond = False
    num_pav += 1


tot_val_cob = 0
tot_val_desc = 0 
for i in range(len(area_cob_pav)):
    tot_val_cob += val_cob * area_cob_pav[i] * .01 * i
    if i > 0 :
        tot_val_desc += (area_cob_pav[i-1] - area_cob_pav[i] ) * val_desc * .01 * i
        
tot_val = tot_val_cob + tot_val_desc


print('valor construido', tot_val_cob + tot_val_desc)
# ---------- end python ----------
move = Move(Geometry=flatten(offset), Motion=Z)  # -> Geometry, Transform
potencial_construtivo_m2 = Panel(multiplication)
area_2 = Area(Geometry=move.Geometry)  # -> Area, Centroid
panel = Panel(python.tot_val_cob)
panel_2 = Panel(python.out)
panel_3 = Panel(python.tot_val_desc)
panel_4 = Panel(python.num_pav)
panel_5 = Panel(python.tot_val)
panel_6 = Panel(python.area_cob_pav)
panel_7 = Panel(python.area_cob_tot)
panel_8 = Panel(python.Volumetria)
# Recuo a partir da altura de cada pavimento
dist = Distance(PointA=flatten(area_2.Centroid), PointB=area.Centroid)
multiplication_2 = Multiplication(A=dist, B=neg)
crv_2 = Curve(move.Geometry)
# 3 - LISTA DAS ÁREAS: COBERTAS E DESCOBERTAS
offset_2 = OffsetCurve(Curve=crv_2, Distance=multiplication_2, Plane=PlaneXY(0, 0, 0), Corners=1)
Z_2 = UnitZ(Factor=entrepiso_m)
srf_2 = Surface(offset_2)
area_3 = Area(Geometry=srf_2)  # -> flatten(Area), Centroid

# ---- group: VOLUMETRIA
extr = Extrude(Base=srf_2, Direction=Z_2)

# ----
ma = MassAddition(Input=area_3.Area)  # -> Result, PartialResults
área_de_cada_pavimento_m2 = Panel(area_3.Area)
panel_9 = Panel(ma.Result)
smaller = SmallerThan(FirstNumber=ma.Result, SecondNumber=potencial_construtivo_m2)  # -> SmallerThan, OrEqualTo
valor_do_metro_quadrado_da_área_descober = Panel("7000")  # "VALOR DO METRO QUADRADO DA ÁREA DESCOBERTA (R$/m2)"
valor_do_metro_quadrado_da_área_coberta = Panel("10000")  # "VALOR DO METRO QUADRADO DA ÁREA COBERTA (R$/m2)"

# ---- group: ÁREA DO TERRAÇO INCLUSA
item = ListItem(List=reverse(área_de_cada_pavimento_m2), Index=0, Wrap=True)
lng_2 = ListLength(List=área_de_cada_pavimento_m2)
ins = InsertItems(List=área_de_cada_pavimento_m2, Item=item, Indices=lng_2, Wrap=True)

# ----
panel_10 = Panel(ins)

# ---- group: TAXA DE VALORIZAÇÃO DO METRO QUADRADO PELA ALTURA DO PAVIMENTO
# colocar para printar apenas o último item da lista
python_2 = GhPythonScript(x=valor_do_metro_quadrado_da_área_descober, y=lng)  # -> out, a
# ---------- python_2: Python ----------
__author__ = "Kyka"
__version__ = "2021.09.28"

import rhinoscriptsyntax as rs
import ghpythonlib


print x
a = x
for i in range(y-1):
    
    a += a * .01
    print a
# ---------- end python_2 ----------
# 4 - PRECIFICAÇÃO DOS PAVIMENTOS
python_3 = GhPythonScript(x=valor_do_metro_quadrado_da_área_coberta, y=lng)  # -> out, a
# ---------- python_3: Python ----------
__author__ = "Kyka"
__version__ = "2021.09.28"

import rhinoscriptsyntax as rs


print x
a = x
for i in range(y-1):
    
    a += a * .01
    print(a)
# ---------- end python_3 ----------

# ----
taxa_de_valorização_para_áreas_descobert = Panel(python_2.out)  # "TAXA DE VALORIZAÇÃO PARA ÁREAS DESCOBERTAS P/ PAVIMENTO"
taxa_de_valorização_para_áreas_cobertas = Panel(python_3.out)  # "TAXA DE VALORIZAÇÃO PARA ÁREAS COBERTAS P/ PAVIMENTO"
multiplication_3 = Multiplication(A=área_de_cada_pavimento_m2, B=taxa_de_valorização_para_áreas_cobertas)

# ---- group: RESOLVER CONDICIONANTE DE APENAS PERMITIR O VALOR DA ÁREA TOTAL 6000m2
galapagos = Galapagos(fitness=num, gene=genes)
# 5 - OTIMIZAÇÃO PARA MAXIMIZAR O VGV
panel_11 = Panel(multiplication_3)
division = Division(A=panel_11, B=área_de_cada_pavimento_m2)
num = Number(division)
panel_12 = Panel(division)
ma_2 = MassAddition(Input=panel_11)  # -> Result, PartialResults
panel_13 = Panel(ma_2.Result)
