# Grasshopper definition malha_espacial.gh (Grasshopper 1.0.7)

surface = Surface(<surface referenced from the Rhino model>)
divide_domain² = DivideDomain²(Domain=surface, UCount=10, VCount=10)
isotrim = Isotrim(Surface=surface, Domain=divide_domain²)
deconstruct_brep = DeconstructBrep(Brep=isotrim)  # -> Faces, Edges, Vertices
area = Area(Geometry=deconstruct_brep.Faces)  # -> Area, Centroid
point = Point([<point referenced from the Rhino model> x4])
surface_2 = Surface(<surface referenced from the Rhino model>)
curve = Curve(deconstruct_brep.Faces)
panel = Panel(area.Centroid)
divide_domain²_2 = DivideDomain²(Domain=surface_2, UCount=10, VCount=10)
divide_surface = DivideSurface(Surface=surface_2, UCount=10, VCount=10)  # -> Points, Normals, Parameters
closest_point = ClosestPoint(Point=area.Centroid, Cloud=point)  # -> ClosestPoint, CPIndex, Distance
curve_2 = Curve(surface_2)
isotrim_2 = Isotrim(Surface=surface_2, Domain=divide_domain²_2)
panel_2 = Panel(closest_point.Distance)
flip_matrix = FlipMatrix(Data=divide_surface.Points)
bounds = Bounds(Numbers=flatten(closest_point.Distance))
deconstruct_brep_2 = DeconstructBrep(Brep=isotrim_2)  # -> Faces, Edges, Vertices
area_2 = Area(Geometry=deconstruct_brep_2.Faces)  # -> Area, Centroid
panel_3 = Panel(deconstruct_brep_2.Edges)
polyline = PolyLine(Vertices=deconstruct_brep_2.Vertices, Closed=True)
curve_3 = Curve(deconstruct_brep_2.Faces)
remap_numbers = RemapNumbers(Value=closest_point.Distance, Source=bounds, Target=Domain(0, 1))  # -> Mapped, Clipped
list_item = ListItem(List=deconstruct_brep_2.Vertices, Index=0, Wrap=True)  # -> Item, Item1, Item2, Item3
evaluate_surface = EvaluateSurface(Surface=reparameterize(deconstruct_brep_2.Faces), Point=".5,.5")  # -> Point, Normal, UDirection, VDirection, Frame
_4point_surface = _4PointSurface(CornerA=list_item.Item, CornerB=list_item.Item1, CornerC=list_item.Item2, CornerD=list_item.Item3)
graph_mapper = GraphMapper(
    remap_numbers.Mapped,
    x0=0,
    x1=1,
    y0=0,
    y1=1,
    container_name="Bezier",
    cpx=[0, 0.1634680778, 0.9680600166, 1],
    cpy=[0, 0.6247550249, 0.2022371292, 1])
panel_5 = Panel(remap_numbers.Mapped)
construct_domain = ConstructDomain(DomainStart=Slider(0.67, range=0..1), DomainEnd=Slider(0.21, range=0..1))
graph_mapper_2 = GraphMapper(
    remap_numbers.Mapped,
    x0=0,
    x1=1,
    y0=0,
    y1=1,
    container_name="Bezier",
    cpx=[0, 0.1634680778, 0.9680600166, 1],
    cpy=[0, 0.6247550249, 0.2022371292, 1])
construct_domain_2 = ConstructDomain(DomainStart=Slider(5.48, range=0..10), DomainEnd=Slider(0.19, range=0..1))
amplitude = Amplitude(Vector=evaluate_surface.Normal, Amplitude=Slider(1.8, range=0..10))
point_2 = Point(Point(0.5, 0.5, 0))
remap_numbers_2 = RemapNumbers(Value=graph_mapper, Source=Domain(0, 1), Target=construct_domain)  # -> Mapped, Clipped
remap_numbers_3 = RemapNumbers(Value=graph_mapper_2, Source=Domain(0, 1), Target=construct_domain_2)  # -> Mapped, Clipped
move = Move(Geometry=area_2.Centroid, Motion=amplitude)  # -> Geometry, Transform
partition_list = PartitionList(List=flatten(move.Geometry), Size=10)
flip_matrix_2 = FlipMatrix(Data=partition_list)
evaluate_surface_2 = EvaluateSurface(Surface=reparameterize(deconstruct_brep.Faces), Point=point_2)  # -> Point, Normal, UDirection, VDirection, Frame
scale = Scale(Geometry=curve, Center=area.Centroid, Factor=remap_numbers_2.Mapped)  # -> Geometry, Transform
polyline_2 = PolyLine(Vertices=partition_list, Closed=False)
polyline_3 = PolyLine(Vertices=flip_matrix, Closed=False)
polyline_4 = PolyLine(Vertices=divide_surface.Points, Closed=False)
polyline_5 = PolyLine(Vertices=flip_matrix_2, Closed=False)
line = Line(StartPoint=deconstruct_brep_2.Vertices, EndPoint=move.Geometry)
panel_6 = Panel(evaluate_surface_2.Normal)
amplitude_2 = Amplitude(Vector=evaluate_surface_2.Normal, Amplitude=remap_numbers_3.Mapped)
move_2 = Move(Geometry=scale.Geometry, Motion=amplitude_2)  # -> Geometry, Transform
merge = Merge(Data1=curve, Data2=move_2.Geometry)
pipe = Pipe(Curve=[line, polyline_4, polyline_3, polyline_2, polyline_5], Radius=Slider(0.095, range=0..1), Caps=0)
panel_7 = Panel(merge)
loft = Loft(Curves=merge, Options={Adjust=False, Closed=False, LoftEnds=0, LoftSimp=0, LoftType=0, Rebuild=10, Refit=0.01})
