# Grasshopper definition teste torre_02.gh (Grasshopper 1.0.7)

number_slider = Slider(33, range=0..100)  # disabled
number_slider_2 = Slider(3, range=0..10)  # disabled
curve = Curve(<curve referenced from the Rhino model>)  # disabled
curve_2 = Curve(<curve referenced from the Rhino model>)
curve_3 = Curve(<curve referenced from the Rhino model>)  # disabled
curve_4 = Curve(<curve referenced from the Rhino model>)
curve_5 = Curve(<curve referenced from the Rhino model>)
panel = Panel(curve_5)
series = Series(Start=0, Step=Slider(3, range=0..10), Count=Slider(33, range=0..100))
series_2 = Series(Start=0, Step=number_slider_2, Count=number_slider)  # disabled
unit_z = UnitZ(Factor=series)
unit_z_2 = UnitZ(Factor=series_2)  # disabled
list_item = ListItem(List=reverse(unit_z), Index=0, Wrap=True)
xy_plane = XYPlane(Origin=Point(0, 0, 0))
move = Move(Geometry=curve, Motion=unit_z_2)  # -> Geometry, Transform; disabled
move_2 = Move(Geometry=curve_4, Motion=list_item)  # -> Geometry, Transform
move_3 = Move(Geometry=curve_2, Motion=unit_z)  # -> Geometry, Transform
move_4 = Move(Geometry=curve_3, Motion=unit_z_2)  # -> Geometry, Transform; disabled
merge = Merge(Data1=simplify(curve_5), Data2=simplify(move_2.Geometry))
control_points = ControlPoints(Curve=move.Geometry)  # -> Points, Weights, Knots; disabled
loft = Loft(Curves=move_3.Geometry, Options={Adjust=False, Closed=False, LoftEnds=0, LoftSimp=0, LoftType=0, Rebuild=10, Refit=0.01})
loft_2 = Loft(Curves=move_4.Geometry, Options={Adjust=False, Closed=False, LoftEnds=0, LoftSimp=0, LoftType=0, Rebuild=10, Refit=0.01})  # disabled
move_5 = Move(Geometry=xy_plane, Motion=unit_z)  # -> Geometry, Transform
number_slider_3 = Slider(0.03, range=0..1)  # disabled
number_slider_4 = Slider(0.03, range=0..1)  # disabled
loft_3 = Loft(Curves=flatten(merge), Options={Adjust=False, Closed=False, LoftEnds=0, LoftSimp=0, LoftType=0, Rebuild=10, Refit=0.01})
deconstruct = Deconstruct(Point=control_points.Points)  # -> XComponent, YComponent, ZComponent; disabled
jitter = Jitter(List=deconstruct.YComponent, Jitter=number_slider_3, Seed=Slider(28, range=0..100))  # -> Values, Indices; disabled
jitter_2 = Jitter(List=deconstruct.XComponent, Jitter=number_slider_4, Seed=2)  # -> Values, Indices; disabled
brep_plane = BrepPlane(Brep=loft_3, Plane=move_5.Geometry)  # -> Curves, Points
construct_point = ConstructPoint(XCoordinate=jitter_2.Values, YCoordinate=jitter.Values, ZCoordinate=deconstruct.ZComponent)  # disabled
number_slider_5 = Slider(0.05, range=0..0.1)  # disabled
nurbs_curve = NurbsCurve(Vertices=construct_point, Degree=3, Periodic=True)  # -> Curve, Length, Domain; disabled
unit_z_3 = UnitZ(Factor=number_slider_5)  # disabled
boundary_surfaces = BoundarySurfaces(Edges=nurbs_curve.Curve)  # disabled
extrude = Extrude(Base=boundary_surfaces, Direction=unit_z_3)  # disabled
