# Grasshopper definition torre_01.gh (Grasshopper 1.0.7)

number_slider = Slider(3, range=0..5)
number_slider_2 = Slider(100, range=2..100)
panel = Panel("""3
6
9""")
series = Series(Start=0, Step=number_slider, Count=number_slider_2)
series_2 = Series(Start=0, Step=Slider(1.5, range=0..90), Count=number_slider_2)
curve = Curve(<curve referenced from the Rhino model>)
curve_2 = Curve([<curve referenced from the Rhino model> x4])  # disabled
ellipse = Ellipse(Plane=PlaneXY(0, 0, 0), Radius1=Slider(23.56, range=1..30), Radius2=Slider(15.11, range=1..30))  # -> Ellipse, Focus1, Focus2
panel_2 = Panel(series)
unit_z = UnitZ(Factor=series)
loft = Loft(Curves=curve_2, Options={Adjust=False, Closed=False, LoftEnds=0, LoftSimp=0, LoftType=0, Rebuild=10, Refit=0.01})  # disabled
unit_z_2 = UnitZ(Factor=number_slider)
panel_3 = Panel(series_2)
move = Move(Geometry=curve, Motion=unit_z)  # -> Geometry, Transform
number_slider_3 = Slider(111, range=0..360)
rotate = Rotate(Geometry=move.Geometry, Angle=degrees(series_2), Plane=PlaneXY(0, 0, 0))  # -> Geometry, Transform
extrude = Extrude(Direction=unit_z_2)
loft_2 = Loft(Curves=rotate.Geometry, Options={Adjust=False, Closed=False, LoftEnds=0, LoftSimp=0, LoftType=0, Rebuild=10, Refit=0.01})
cap_holes = CapHoles(Brep=extrude)
cap_holes_2 = CapHoles(Brep=loft_2)
