# Grasshopper definition varandas_alernadas_v2_testes_parede_curva.gh (Grasshopper 1.0.7)

surface = Surface(<surface referenced from the Rhino model>)
surface_frames = SurfaceFrames(Surface=surface, UCount=Slider(9, range=0..100), VCount=Slider(7, range=0..100))  # -> Frames, Parameters
deconstruct_plane = DeconstructPlane(Plane=surface_frames.Frames)  # -> Origin, XAxis, YAxis, ZAxis
vector = Vector(deconstruct_plane.ZAxis)
vector_2 = Vector(deconstruct_plane.XAxis)
vector_3 = Vector(deconstruct_plane.YAxis)
list_item = ListItem(List=flatten(vector_2), Index=0, Wrap=True)
list_item_2 = ListItem(List=flatten(vector), Index=0, Wrap=True)
list_item_3 = ListItem(List=flatten(vector_3), Index=0, Wrap=True)

# ---- group: espessura das paredes
number_slider = Slider(0.15, range=0..1)
division = Division(A=number_slider, B="2")
negative = Negative(Value=division)
amplitude = Amplitude(Vector=list_item, Amplitude=division)
amplitude_2 = Amplitude(Vector=list_item, Amplitude=negative)
move = Move(Geometry=deconstruct_plane.Origin, Motion=amplitude_2)  # -> Geometry, Transform
move_2 = Move(Geometry=deconstruct_plane.Origin, Motion=amplitude)  # -> Geometry, Transform
panel = Panel("""0
1""")
weave = Weave(Pattern=panel, Stream0=move.Geometry, Stream1=move_2.Geometry, NullGaps=False)  # -> simplify(Weave)

# ----
stack_data = StackData(Data=vector_3, Stack="4")  # -> simplify(Data)

panel_2 = Panel("""1
0""")
tree_statistics = TreeStatistics(Tree=weave)  # -> Paths, Length, Count
panel_3 = Panel("""True
True
False
False""")
dispatch = Dispatch(List=tree_statistics.Paths, DispatchPattern=panel_2)  # -> ListA, ListB
data = Data(panel_3)
tree_branch = TreeBranch(Tree=weave, Path=dispatch.ListB, MaintainPaths=True)
tree_branch_2 = TreeBranch(Tree=weave, Path=dispatch.ListA, MaintainPaths=True)
dispatch_2 = Dispatch(List=tree_branch_2, DispatchPattern=data)  # -> ListA, ListB
dispatch_3 = Dispatch(List=tree_branch, DispatchPattern=data)  # -> ListA, ListB

tree_statistics_2 = TreeStatistics(Tree=vector)  # -> Paths, Length, Count
dispatch_4 = Dispatch(List=tree_statistics_2.Paths, DispatchPattern=panel_2)  # -> ListA, ListB
tree_branch_3 = TreeBranch(Tree=vector, Path=dispatch_4.ListA, MaintainPaths=True)
tree_branch_4 = TreeBranch(Tree=vector, Path=dispatch_4.ListB, MaintainPaths=True)

vector_4 = Vector(tree_branch_4)
vector_5 = Vector(tree_branch_3)

# ---- group: Varanda: Profundidade maior
amplitude_3 = Amplitude(Vector=list_item_2, Amplitude=Slider(3, range=0..10))
move_3 = Move(Geometry=dispatch_3.ListB, Motion=amplitude_3)  # -> Geometry, Transform
move_4 = Move(Geometry=dispatch_2.ListA, Motion=amplitude_3)  # -> Geometry, Transform

# ---- group: Varanda: profundidade menor
amplitude_4 = Amplitude(Vector=list_item_2, Amplitude=Slider(0.2, range=0..10))
move_5 = Move(Geometry=dispatch_2.ListB, Motion=amplitude_4)  # -> Geometry, Transform
move_6 = Move(Geometry=dispatch_3.ListA, Motion=amplitude_4)  # -> Geometry, Transform

# ----
panel_4 = Panel("""0
0
1
1
2
2
3
3""")
weave_2 = Weave(
    Pattern=panel_4,
    Stream0=dispatch_3.ListA,
    Stream1=move_6.Geometry,
    Stream2=move_3.Geometry,
    Stream3=dispatch_3.ListB,
    NullGaps=False)
weave_3 = Weave(
    Pattern=panel_4,
    Stream0=dispatch_2.ListA,
    Stream1=move_4.Geometry,
    Stream2=move_5.Geometry,
    Stream3=dispatch_2.ListB,
    NullGaps=False)
merge = Merge(Data1=weave_3, Data2=weave_2)

# ---- group: Espessura das lajes
negative_2 = Negative(Value=Slider(0.2, range=0..1))
amplitude_5 = Amplitude(Vector=list_item_3, Amplitude=negative_2)
move_7 = Move(Geometry=merge, Motion=amplitude_5)  # -> Geometry, Transform

# ---- group: Varandas
panel_5 = Panel("""1
0""")
dispatch_5 = Dispatch(List=merge, DispatchPattern=panel_5)  # -> ListA, ListB
data_2 = Data(dispatch_5.ListA)
data_3 = Data(dispatch_5.ListB)
tree_statistics_3 = TreeStatistics(Tree=data_3)  # -> Paths, Length, Count
tree_statistics_4 = TreeStatistics(Tree=data_2)  # -> Paths, Length, Count
cull_index = CullIndex(List=reverse(tree_statistics_3.Paths), Indices=0, Wrap=True)  # -> reverse(List)
cull_index_2 = CullIndex(List=tree_statistics_4.Paths, Indices=0, Wrap=True)
tree_branch_5 = TreeBranch(Tree=dispatch_5.ListB, Path=cull_index, MaintainPaths=True)
tree_branch_6 = TreeBranch(Tree=data_2, Path=cull_index_2, MaintainPaths=True)
line = Line(StartPoint=tree_branch_6, EndPoint=tree_branch_5)
partition_list = PartitionList(List=line, Size="2")
loft = Loft(Curves=partition_list, Options={Adjust=False, Closed=False, LoftEnds=0, LoftSimp=0, LoftType=0, Rebuild=10, Refit=0.01})
extrude = Extrude(Base=loft, Direction=amplitude_5)

# ---- group: Lajes sob paredes
partition_list_2 = PartitionList(List=merge, Size="4")
surface_from_points = SurfaceFromPoints(Points=partition_list_2, UCount="2", Interpolate=False)
extrude_2 = Extrude(Base=surface_from_points, Direction=amplitude_5)

# ----
panel_6 = Panel("""0
0
0
0
1
1
1
1""")
weave_4 = Weave(Pattern=panel_6, Stream0=move_7.Geometry, Stream1=merge, NullGaps=False)

# ---- group: paredes
shift_list = ShiftList(List=weave_4, Shift="4", Wrap=Toggle(False))
dispatch_6 = Dispatch(List=shift_list, DispatchPattern=[True, False])  # -> ListA, ListB
amplitude_6 = Amplitude(Vector=list_item, Amplitude=number_slider)
partition_list_3 = PartitionList(List=dispatch_6.ListA, Size="4")
prune_tree = PruneTree(Tree=partition_list_3, Minimum="4", Maximum=0)
polyline = PolyLine(Vertices=prune_tree, Closed="True")
extrude_3 = Extrude(Base=polyline, Direction=amplitude_6)
cap_holes = CapHoles(Brep=extrude_3)
