# Grasshopper definition TER_01_terreno_3d_V00.gh (Grasshopper 1.0.7)
# plug-ins: EleFront, MetaHopper

# ---- group: Layer raiz do levantamento topográfico
panel = Panel("Sicar")

# ---- group: Layers das curvas de nível
panel_2 = Panel("""5
6""")

# ----
concatenate = Concatenate(Fragment_A=panel, Fragment_B="::", A=panel_2)

# ----
# 3 - Clique nos botões para fazer
# Update das das referências
reference_by_user_atributes_r6 = ReferenceByUserAtributesR6(Key="bbox_entorno", Val="True", DisableAutoUpdate=False)
reference_by_layer_r6 = ReferenceByLayerR6(LayerName=concatenate, DisableAutoUpdate=False)  # -> flatten(Geometry)

value_list = ValueList({"Point": 0, "Curve": 1, "Arc": 2, "Circle": 3, "Ellipse": 4, "Line": 5, "Polyline": 6, "Surface": 7, "Brep": 8, "Mesh": 9, "Polysurface": 10, "Block": 11, "Text": 12, "TextDot": 13, "Dimension": 14, "LinearDimension": 15, "AngularDimension": 16, "Hatch": 17, "Leader": 18}, selected="Curve")
filter_by_type_r6 = FilterByTypeR6(Geometry=reference_by_layer_r6, ObjectType=value_list)

# ----
# 3B - OPCIONAL - gera um arquivo  texto
# com as coordenadas XYZ
# dos pontos XYZ das curvas de nível
# recortadas para o entorno da edificação
button = Button()

# ----
# 4 - Clique no botão para gerar
# os layers para colocar os modelos 3D
button_2 = Button()

concatenate_2 = Concatenate(Fragment_A="3D", Fragment_B="::", A="Terreno_entorno")
concatenate_3 = Concatenate(Fragment_A="3D", Fragment_B="::", A="Terreno")
colour_swatch = ColourSwatch(SwatchColor=RGB(92, 153, 17))
define_layer_r6 = DefineLayerR6(Name=concatenate_2, Color=colour_swatch)
define_layer_r6_2 = DefineLayerR6(Name=concatenate_3, Color=ColourSwatch(SwatchColor=RGB(78, 201, 50)))
bake_modify_layer_r6 = BakeModifyLayerR6(Layer=define_layer_r6, Bake=button_2)
bake_modify_layer_r6_2 = BakeModifyLayerR6(Layer=define_layer_r6_2, Bake=button_2)

# ----
# 6 - Clique nos botões
# Update e Activate (nesta ordem)
#  para exportar
# uma uma cópia da
# geometria e dos dados
# para o arquivo
panel_3 = Panel("TER_02_terreno_3d_V00")

# ----
# 5 - Gera o terreno e o entorno
# como sólidos separados
button_3 = Button()

reference_by_layer_r6_2 = ReferenceByLayerR6(LayerName="*", DisableAutoUpdate=True)
relative_path = RelativePath(Path=".\")
guid = Guid(reference_by_layer_r6_2)
export_objects_r6 = ExportObjectsR6(
    FolderPath=relative_path,
    FileName=panel_3,
    FileExtension=".3dm",
    RhinoObjects=guid,
    AxisSystem=PlaneXY(0, 0, 0),
    Export=False)

# ----
# 1 - Clique no botão para gerar o Layer
# 
# No Rhino, ative o Layer criado e desenhe uma
# curva fechada delimitando o
# terreno com o entorno
# que deseja modelar em 3D
button_4 = Button()

# ---- group: Criação de Layers
panel_4 = Panel("Info")
panel_5 = Panel("::")
concatenate_4 = Concatenate(Fragment_A=panel_4, Fragment_B=panel_5, A="3d_region")
define_layer_r6_3 = DefineLayerR6(Name=concatenate_4, Color=ColourSwatch(SwatchColor=RGB(61, 99, 212)))
bake_modify_layer_r6_3 = BakeModifyLayerR6(Layer=define_layer_r6_3, Bake=button_4)

# ----
panel_6 = Panel(concatenate_4)

# ----
# 2- Apos desenhar a curva,
# clique no botão updade
# para selecionar o contorno
reference_by_layer_r6_3 = ReferenceByLayerR6(LayerName=concatenate_4, DisableAutoUpdate=True)

value_list_2 = ValueList({"bbox_altura_total", "bbox_entorno", "bbox_z_max", "bbox_z_min", "layer_color", "original_layer"}, selected="bbox_altura_total")
get_user_value_r6 = GetUserValueR6(Geometry=reference_by_user_atributes_r6, Key=value_list_2)
panel_7 = Panel(get_user_value_r6)
multiplication = Multiplication(A=get_user_value_r6, B=Slider(1.25, range=1..10))
negative = Negative(Value=multiplication)
construct_point = ConstructPoint(XCoordinate=0, YCoordinate=0, ZCoordinate=negative)
xy_plane = XYPlane(Origin=construct_point)
project = Project(Geometry=reference_by_layer_r6_3, Plane=xy_plane)  # -> Geometry, Transform
multiplication_2 = Multiplication(A=multiplication, B="2")
surface = Surface(project.Geometry)
unit_z = UnitZ(Factor=multiplication_2)
extrude = Extrude(Base=surface, Direction=unit_z)

area = Area(Geometry=project.Geometry)  # -> Area, Centroid
offset_curve = OffsetCurve(Curve=project.Geometry, Distance=Slider(71.59, range=0..100), Plane=area.Centroid, Corners=1)
surface_2 = Surface(offset_curve)
extrude_2 = Extrude(Base=surface_2, Direction=unit_z)

trim_with_brep = TrimWithBrep(Curve=filter_by_type_r6, Brep=extrude_2)  # -> Inside, Outside
construct_point_2 = ConstructPoint(XCoordinate=0, YCoordinate=0, ZCoordinate=negative)
patch = Patch(Curves=flatten(trim_with_brep.Inside), Spans=20, Flexibility=1, Trim=False)
xy_plane_2 = XYPlane(Origin=construct_point_2)
curve = Curve(patch)
project_2 = Project(Geometry=curve, Plane=xy_plane_2)  # -> Geometry, Transform
merge = Merge(Data1=curve, Data2=project_2.Geometry)  # -> flatten(Result)
boolean_toggle = BooleanToggle(True)
loft = Loft(Curves=merge, Options={Adjust=False, Closed=False, LoftEnds=0, LoftSimp=0, LoftType=0, Rebuild=10, Refit=0.01})
cap_holes = CapHoles(Brep=loft)
merge_2 = Merge(Data1=patch, Data2=cap_holes)  # -> flatten(Result)
brep_join = BrepJoin(Breps=merge_2)  # -> Breps, Closed
solid_intersection = SolidIntersection(BrepsA=extrude, BrepsB=brep_join.Breps)

concatenate_5 = Concatenate(Fragment_A=panel_4, Fragment_B=panel_5, A="limites_terreno")
number_slider = Slider(1.07, range=1..2)
reference_by_layer_r6_4 = ReferenceByLayerR6(LayerName=concatenate_5, DisableAutoUpdate=False)
multiplication_3 = Multiplication(A=negative, B=number_slider)
multiplication_4 = Multiplication(A=multiplication, B=number_slider)
construct_point_3 = ConstructPoint(XCoordinate=0, YCoordinate=0, ZCoordinate=multiplication_3)
construct_point_4 = ConstructPoint(XCoordinate=0, YCoordinate=0, ZCoordinate=multiplication_4)
xy_plane_3 = XYPlane(Origin=construct_point_3)
project_3 = Project(Geometry=reference_by_layer_r6_4, Plane=xy_plane_3)  # -> Geometry, Transform
vector_2pt = Vector2Pt(PointA=construct_point_3, PointB=construct_point_4, Unitize=False)  # -> Vector, Length
extrude_3 = Extrude(Base=project_3.Geometry, Direction=vector_2pt.Vector)
cap_holes_2 = CapHoles(Brep=extrude_3)

explode = Explode(Curve=trim_with_brep.Inside, Recursive=True)  # -> Segments, Vertices
value_list_3 = ValueList({"Archicad": "archicad", "Revit": "revit"}, selected="Revit")
relative_path_2 = RelativePath(Path=".\")
ghpython_script = GhPythonScript(
    terrain_points=flatten(explode.Vertices),
    folder=relative_path_2,
    file_name="coordenadas.txt",
    separator=value_list_3,
    run=button)  # inputs terrain_points: list of Point3d, run: Boolean
# ---------- ghpython_script: Python ----------
__author__ = "Nando"
__version__ = "2024.06.05"
import  os
import rhinoscriptsyntax as rs
from Rhino.Geometry import Point3d

if separator is None:
    separator = " "
if separator.lower() == "archicad":
    separator = " "
if separator.lower() == "revit":
    separator = ","


if _run == True:
    with open(folder + file_name, 'w')  as corrds:
        for p in terrain_points:
            corrds.write("{}{}{}{}{}\n".format(p.X,separator,p.Y,separator,p.Z  ))
# ---------- end ghpython_script ----------

area_2 = Area(Geometry=project_3.Geometry)  # -> Area, Centroid
suirify = Suirify(area_2.Area)
suirify_2 = Suirify(unit_z)
merge_3 = Merge(Data1=suirify, Data2=suirify_2, Data3=concatenate_3, Data4=colour_swatch)  # -> flatten(Result)
merge_4 = Merge(Data1="area_proj", Data2="coord_z_plano_base", Data3="original_layer", Data4="layer_color")
solid_intersection_2 = SolidIntersection(BrepsA=solid_intersection, BrepsB=cap_holes_2)
solid_difference = SolidDifference(BrepsA=solid_intersection, BrepsB=cap_holes_2)
define_object_attributes_r6 = DefineObjectAttributesR6(UserKeys=merge_4, UserValues=merge_3, Layer=define_layer_r6_2)
merge_5 = Merge(Data1="entorno_solido", Data2="original_layer", Data3="layer_color")
merge_6 = Merge(Data1=Toggle(True), Data2=concatenate_2, Data3=colour_swatch)
bake_objects_r6 = BakeObjectsR6(Geometry=solid_intersection_2, Attributes=define_object_attributes_r6, BakeName="terreno_solido", Bake=button_3)
define_object_attributes_r6_2 = DefineObjectAttributesR6(UserKeys=merge_5, UserValues=merge_6, Layer=define_layer_r6)
bake_objects_r6_2 = BakeObjectsR6(Geometry=solid_difference, Attributes=define_object_attributes_r6_2, BakeName="entorno_solido", Bake=button_3)

panel_8 = Panel(merge_3)
