# Grasshopper definition teste_terreno.gh (Grasshopper 1.0.8)
# plug-ins: EleFront

file_path = FilePath("D:\gitrepos\introducao_a_modelagem_parametrica\dl_assets\")
plane = Plane(PlaneXY(-32.0317927, 20.8157949, 0))
import_linked_block_r6 = ImportLinkedBlockR6(PathOfFolder=file_path, BlockNameFileName="*", SourcePlane=plane)
panel = Panel(file_path)
value_list = ValueList({"Default", "Layer 01", "Layer 02", "Layer 03", "Layer 04", "Layer 05"}, selected="Default")
deconstruct_block_r6 = DeconstructBlockR6(Block=import_linked_block_r6)  # -> Name, Plane, Geometry
text_split = TextSplit(Text=file_path, Separators="\")
filter_by_layer_r6 = FilterByLayerR6(Geometry=deconstruct_block_r6.Geometry, Layer=value_list)
cull_index = CullIndex(List=text_split, Indices="0", Wrap=True)
concatenate = Concatenate()
panel_2 = Panel(cull_index)
panel_3 = Panel(text_split)
insert_items = InsertItems(List=cull_index, Item=".", Indices="0", Wrap=True)
text_join = TextJoin(Text=insert_items, Join="\")
create_tree_r6 = CreateTreeR6()
panel_4 = Panel(insert_items)
panel_5 = Panel(text_join)
