# Grasshopper definition aractor_example_point_curve.gh (Grasshopper 1.0.8)

plane_surface = PlaneSurface(Plane=PlaneXY(0, 0, 0), XSize=Domain(-10, 10), YSize=Domain(-10, 10))

surface = Surface(plane_surface)
populate_geometry = PopulateGeometry(Geometry=surface, Count=Slider(200, range=0..200), Seed=Slider(35, range=0..200))

point = Point([Point(5.409725676, 7.236368474, 0), Point(-7.321296856, -6.146803736, 0)])
closest_point = ClosestPoint(Point=populate_geometry, Cloud=point)  # -> ClosestPoint, CPIndex, Distance
bounds = Bounds(Numbers=closest_point.Distance)
construct_domain = ConstructDomain(DomainStart=Slider(0.25, range=0..1), DomainEnd=Slider(0.83, range=0..1))
remap_numbers = RemapNumbers(Value=closest_point.Distance, Source=bounds, Target=construct_domain)  # -> Mapped, Clipped

curve = Curve(surface)
voronoi = Voronoi(Points=populate_geometry, Boundary=curve, BruteForceOverride=False)

area = Area(Geometry=voronoi)  # -> Area, Centroid
scale = Scale(Geometry=voronoi, Center=area.Centroid, Factor=remap_numbers.Mapped)  # -> Geometry, Transform
fillet_distance = FilletDistance(Curve=scale.Geometry, Distance=Slider(0.9, range=0..1))

panel = Panel(voronoi)
panel_2 = Panel(scale.Geometry)

curve_2 = Curve(<curve referenced from the Rhino model>)
curve_closest_point = CurveClosestPoint(Point=area.Centroid, Curve=curve_2)  # -> Point, Parameter, Distance
bounds_2 = Bounds(Numbers=curve_closest_point.Distance)
construct_domain_2 = ConstructDomain(DomainStart=Slider(0.11, range=0..1), DomainEnd=Slider(0.82, range=0..1))
remap_numbers_2 = RemapNumbers(Value=curve_closest_point.Distance, Source=bounds_2, Target=construct_domain_2)  # -> Mapped, Clipped

graft_tree = GraftTree(Tree=voronoi, IncludeEmptyLists=True, IncludeNullItems=True)
graft_tree_2 = GraftTree(Tree=fillet_distance, IncludeEmptyLists=True, IncludeNullItems=True)
merge = Merge(Data1=graft_tree, Data2=graft_tree_2)
boundary_surfaces = BoundarySurfaces(Edges=merge)  # -> flatten(Surfaces)

panel_3 = Panel(graft_tree)
panel_4 = Panel(graft_tree_2)
panel_5 = Panel(merge)
panel_6 = Panel(boundary_surfaces)
unit_z = UnitZ(Factor=remap_numbers_2.Mapped)
panel_7 = Panel(unit_z)
extrude = Extrude(Base=boundary_surfaces, Direction=unit_z)

create_material = CreateMaterial(
    Diffuse=ColourSwatch(SwatchColor=RGB(47, 131, 135)),
    Specular=RGB(255, 255, 255),
    Emission=RGB(0, 0, 0),
    Transparency=0,
    Shine=0)
custom_preview = CustomPreview(Geometry=extrude, Material=create_material)
