# Grasshopper definition voronoi_example_02.gh (Grasshopper 1.0.7)

plane_surface = PlaneSurface(Plane=PlaneXY(0, 0, 0), XSize=Domain(-10, 10), YSize=Domain(-10, 10))

surface = Surface(plane_surface)
populate_geometry = PopulateGeometry(Geometry=surface, Count=Slider(70, range=0..200), Seed=Slider(3, range=0..200))

md_slider = MDSlider(
    SliderMode=0,
    slider_value=Point(0.5400111661, 0.2265539402, 0.5),
    x_domain=Domain(0, 1),
    y_domain=Domain(0, 1),
    z_domain=Domain(0, 1))
evaluate_surface = EvaluateSurface(Surface=reparameterize(surface), Point=md_slider)  # -> Point, Normal, UDirection, VDirection, Frame
circle = Circle(Plane=evaluate_surface.Frame, Radius=Slider(5.32, range=0..10))
region_intersection = RegionIntersection(CurvesA=surface, CurvesB=circle)
boundary_surfaces = BoundarySurfaces(Edges=region_intersection)
panel = Panel(region_intersection)
populate_geometry_2 = PopulateGeometry(Geometry=boundary_surfaces, Count=Slider(47, range=0..100), Seed=1)

merge = Merge(Data1=populate_geometry, Data2=populate_geometry_2)
point = Point(flatten(merge))

curve = Curve(surface)
voronoi = Voronoi(Points=point, Boundary=curve, BruteForceOverride=False)

area = Area(Geometry=voronoi)  # -> Area, Centroid
scale = Scale(Geometry=voronoi, Center=area.Centroid, Factor=Slider(0.41, range=0..1))  # -> Geometry, Transform
fillet_distance = FilletDistance(Curve=scale.Geometry, Distance=Slider(0.5, range=0..1))

panel_2 = Panel(voronoi)

curve_2 = Curve(<curve referenced from the Rhino model>)
curve_closest_point = CurveClosestPoint(Point=area.Centroid, Curve=curve_2)  # -> Point, Parameter, Distance
bounds = Bounds(Numbers=curve_closest_point.Distance)
construct_domain = ConstructDomain(DomainStart=Slider(2, range=0..10), DomainEnd=Slider(0.02, range=0..1))
remap_numbers = RemapNumbers(Value=curve_closest_point.Distance, Source=bounds, Target=construct_domain)  # -> Mapped, Clipped

graft_tree = GraftTree(Tree=voronoi, IncludeEmptyLists=True, IncludeNullItems=True)
graft_tree_2 = GraftTree(Tree=fillet_distance, IncludeEmptyLists=True, IncludeNullItems=True)
panel_3 = Panel(graft_tree)
unit_z = UnitZ(Factor=remap_numbers.Mapped)
panel_4 = Panel(fillet_distance)
panel_5 = Panel(graft_tree_2)
merge_2 = Merge(Data1=graft_tree, Data2=graft_tree_2)
panel_6 = Panel(merge_2)
panel_7 = Panel(unit_z)
boundary_surfaces_2 = BoundarySurfaces(Edges=merge_2)  # -> flatten(Surfaces)
extrude = Extrude(Base=boundary_surfaces_2, Direction=unit_z)
panel_8 = Panel(boundary_surfaces_2)
create_material = CreateMaterial(
    Diffuse=ColourSwatch(SwatchColor=RGB(47, 131, 135)),
    Specular=RGB(255, 255, 255),
    Emission=RGB(0, 0, 0),
    Transparency=0,
    Shine=0)
custom_preview = CustomPreview(Geometry=extrude, Material=create_material)
