# Grasshopper definition brise_param_2026_a.gh (Grasshopper 1.0.7)

number_slider = Slider(15, range=0..100)
curve = Curve(<curve referenced from the Rhino model>)

# ---- group: Eixos montantes
# LINHA ENTRE DOIS PONTOS
# DIVIDE CURVAS
# MOVE OBJETOS
# Versor Z
divide_curve = DivideCurve(Curve=curve, Count=number_slider, Kinks=False)  # -> Points, Tangents, Parameters
unit_z = UnitZ(Factor=Slider(43.64, range=0..100))
panel = Panel(divide_curve.Points)
point = Point(divide_curve.Points)
move = Move(Geometry=point, Motion=unit_z)  # -> Geometry, Transform
panel_2 = Panel(move.Geometry)
line = Line(StartPoint=point, EndPoint=move.Geometry)

# ----
construct_plane = ConstructPlane(Origin=point, XAxis=divide_curve.Tangents, YAxis=Vector(0, 1, 0))

# ---- group: base montante
division = Division(A=Slider(0.34, range=0..10), B=2)
division_2 = Division(A=Slider(0.99, range=0..10), B=2)
negative = Negative(Value=division)
negative_2 = Negative(Value=division_2)
panel_3 = Panel(division_2)
panel_4 = Panel(division)
construct_domain = ConstructDomain(DomainStart=negative_2, DomainEnd=division_2)
panel_5 = Panel(negative_2)
construct_domain_2 = ConstructDomain(DomainStart=negative, DomainEnd=division)
panel_6 = Panel(negative)
panel_7 = Panel(construct_domain_2)
rectangle = Rectangle(Plane=construct_plane, XSize=construct_domain_2, YSize=construct_domain, Radius=0)  # -> Rectangle, Length

# ----
boundary_surfaces = BoundarySurfaces(Edges=rectangle.Rectangle)
list_length = ListLength(List=line)
extrude_along = ExtrudeAlong(Base=boundary_surfaces, Curve=line)
panel_8 = Panel(list_length)
number_slider_2 = Slider(9, range=0..100)
cull_index = CullIndex(List=line, Indices=number_slider, Wrap=True)
cull_index_2 = CullIndex(List=line, Indices="0", Wrap=True)
divide_curve_2 = DivideCurve(Curve=cull_index_2, Count=number_slider_2, Kinks=False)  # -> Points, Tangents, Parameters
divide_curve_3 = DivideCurve(Curve=cull_index, Count=number_slider_2, Kinks=False)  # -> Points, Tangents, Parameters
line_2 = Line(StartPoint=divide_curve_3.Points, EndPoint=divide_curve_2.Points)
panel_9 = Panel(divide_curve_3.Points)
panel_10 = Panel(divide_curve_2.Points)
