# Grasshopper definition brise_param_2026_b.gh (Grasshopper 1.0.7)

curve = Curve(<curve referenced from the Rhino model>)

# ---- group: Eixos montantes
# LINHA ENTRE DOIS PONTOS
# DIVIDE CURVAS
# MOVE OBJETOS
# Versor Z
divide_curve = DivideCurve(Curve=curve, Count=Slider(15, range=0..100), Kinks=False)  # -> Points, Tangents, Parameters
unit_z = UnitZ(Factor=Slider(43.64, range=0..100))
panel = Panel(divide_curve.Points)
point = Point(divide_curve.Points)
move = Move(Geometry=point, Motion=unit_z)  # -> Geometry, Transform
panel_2 = Panel(move.Geometry)
line = Line(StartPoint=point, EndPoint=move.Geometry)

# ----
angulo = Slider(0, range=0..360)
dim_y = Slider(0.99, range=0..10)
dim_x = Slider(0.34, range=0..10)
construct_plane = ConstructPlane(Origin=point, XAxis=divide_curve.Tangents, YAxis=Vector(0, 1, 0))
rect_center = RectCenter(plane=construct_plane, angle=angulo, dimension_x=dim_x, dimension_y=dim_y)  # -> surfaces, rectangle_2
closed = Closed(Curve=curve)  # -> Closed, Periodic
panel_3 = Panel(closed.Closed)
list_length = ListLength(List=line)
panel_4 = Panel(list_length)
shift_list = ShiftList(List=line, Shift=1, Wrap=closed.Closed)
number_slider = Slider(11, range=0..100)
shortest_list = ShortestList(ListA=line, ListB=shift_list, TrimMode=2)  # -> ListA, ListB
divide_curve_2 = DivideCurve(Curve=shift_list, Count=number_slider, Kinks=False)  # -> Points, Tangents, Parameters
divide_curve_3 = DivideCurve(Curve=shortest_list.ListA, Count=number_slider, Kinks=False)  # -> Points, Tangents, Parameters
extrude_along = ExtrudeAlong(Base=rect_center.surfaces, Curve=line)
panel_5 = Panel(divide_curve_3.Points)
panel_6 = Panel(divide_curve_2.Points)
line_2 = Line(StartPoint=divide_curve_3.Points, EndPoint=divide_curve_2.Points)
construct_plane_2 = ConstructPlane(Origin=divide_curve_3.Points, XAxis=line_2, YAxis=line)
deconstruct_plane = DeconstructPlane(Plane=construct_plane_2)  # -> Origin, XAxis, YAxis, ZAxis
angulo_2 = Slider(45, range=0..360)
dim_y_2 = Slider(3.37, range=0..10)
dim_x_2 = Slider(0.22, range=0..10)
construct_plane_3 = ConstructPlane(Origin=deconstruct_plane.Origin, XAxis=deconstruct_plane.ZAxis, YAxis=deconstruct_plane.YAxis)
rect_center_2 = RectCenter(plane=construct_plane_3, angle=angulo_2, dimension_x=dim_x_2, dimension_y=dim_y_2)  # -> surfaces, rectangle_2
extrude_along_2 = ExtrudeAlong(Base=rect_center_2.surfaces, Curve=line_2)

# ==== cluster RectCenter: cria uma superfície retangular centralizada no plano e rotacionada
dimension_y = ClusterInput()  # Controla a dimensão Y da superfície retangular
dimension_x = ClusterInput()  # Dimensão x da superfície retangular
angle = ClusterInput()
plane = ClusterInput()

# ---- group: base montante
division = Division(A=dimension_x, B=2)
division_2 = Division(A=dimension_y, B=2)
negative = Negative(Value=division)
negative_2 = Negative(Value=division_2)
panel = Panel(division_2)
construct_domain = ConstructDomain(DomainStart=negative_2, DomainEnd=division_2)
panel_2 = Panel(division)
panel_3 = Panel(negative_2)
construct_domain_2 = ConstructDomain(DomainStart=negative, DomainEnd=division)
panel_4 = Panel(negative)
panel_5 = Panel(construct_domain_2)
rotate_plane = RotatePlane(Plane=plane, Angle=degrees(angle))
rectangle = Rectangle(Plane=rotate_plane, XSize=construct_domain_2, YSize=construct_domain, Radius=0)  # -> Rectangle, Length

# ----
boundary_surfaces = BoundarySurfaces(Edges=rectangle.Rectangle)
rectangle_2 = ClusterOutput(rectangle.Rectangle)
surfaces = ClusterOutput(boundary_surfaces)
