# Grasshopper definition conceitos.gh (Grasshopper 1.0.7)

construct_domain = ConstructDomain(DomainStart=0, DomainEnd=1)
rectangle = Rectangle(Plane=PlaneXY(0, 0, 0), XSize=Domain(-1, 1), YSize=Domain(-2, 2), Radius=0)  # -> Rectangle, Length
xy_plane = XYPlane(Origin=Point(0, 0, 0))
yz_plane = YZPlane(Origin=Point(0, 0, 0))
xz_plane = XZPlane(Origin=Point(0, 0, 0))
panel = Panel(construct_domain)
range = Range(Domain=construct_domain, Steps=10)
rotate_plane = RotatePlane()
plane_origin = PlaneOrigin()
deconstruct_plane = DeconstructPlane(Plane=PlaneXY(0, 0, 0))  # -> Origin, XAxis, YAxis, ZAxis
panel_2 = Panel(range)
sine = Sine(Value=range)
construct_point = ConstructPoint(XCoordinate=range, YCoordinate=sine, ZCoordinate=0)
panel_3 = Panel(construct_point)
unit_y = UnitY(Factor=1)
curve = Curve()
move = Move(Geometry=curve, Motion=unit_y)  # -> Geometry, Transform
shortest_list = ShortestList(TrimMode=2)  # -> ListA, ListB
longest_list = LongestList(PaddingMode=2)  # -> ListA, ListB
cross_reference = CrossReference(CrossMode=1)  # -> ListA, ListB
divide_curve = DivideCurve(Curve=curve, Count=10, Kinks=False)  # -> Points, Tangents, Parameters
divide_curve_2 = DivideCurve(Curve=move.Geometry, Count=10, Kinks=False)  # -> Points, Tangents, Parameters
line = Line(StartPoint=divide_curve.Points, EndPoint=divide_curve_2.Points)
vector_display = VectorDisplay()
vector_display_ex = VectorDisplayEx(Colour=ColourSwatch(SwatchColor=RGB(255, 255, 255)), Width=2)
