# Grasshopper definition multipav_base_op_03.gh (Grasshopper 1.0.8)

# ---- group: Criando Superfície
curve = Curve([<curve referenced from the Rhino model> x2])
boundary_surfaces = BoundarySurfaces(Edges=curve)

# ---- group: sequência: número de andares e distância piso à piso
number_slider = Slider(37, range=0..50)
series = Series(Start=Slider(0, range=0..10), Step=Slider(3, range=0..10), Count=number_slider)

# ---- group: Planos: um plano para cada nível
point = Point(Point(61, 24, 0))
base_point = Point(Point(-17, 47, 0))
xy_plane = XYPlane(Origin=Point(0, 0, 0))
deconstruct = Deconstruct(Point=point)  # -> XComponent, YComponent, ZComponent
plane_origin = PlaneOrigin(Base=xy_plane, Origin=base_point)
deconstruct_plane = DeconstructPlane(Plane=plane_origin)  # -> Origin, XAxis, YAxis, ZAxis
construct_point = ConstructPoint(XCoordinate=deconstruct.XComponent, YCoordinate=deconstruct.YComponent, ZCoordinate=series)
construct_plane = ConstructPlane(Origin=construct_point, XAxis=deconstruct_plane.XAxis, YAxis=deconstruct_plane.YAxis)

# ---- group: Solução 03: Orientar para cada plano
construct_domain = ConstructDomain(DomainStart=0, DomainEnd=Slider(123.74, range=0..180))
subtraction = Subtraction(A=number_slider, B="1")
range = Range(Domain=construct_domain, Steps=subtraction)
rotate_plane = RotatePlane(Plane=construct_plane, Angle=degrees(range))
orient = Orient(Geometry=boundary_surfaces, Source=plane_origin, Target=rotate_plane)  # -> Geometry, Transform

# ---- group: espessura da laje
negative = Negative(Value=Slider(0.56, range=0.01..0.7))
unit_z = UnitZ(Factor=negative)
extrude = Extrude(Base=orient.Geometry, Direction=unit_z)

# ----
panel = Panel(orient.Geometry)
panel_2 = Panel(extrude)
