# Grasshopper definition random_tower.gh (Grasshopper 1.0.8)

number_slider = Slider(3, range=0..10)
curve = Curve(<curve referenced from the Rhino model>)

series = Series(Start=0, Step=number_slider, Count=Slider(37, range=0..100))
unit_z = UnitZ(Factor=series)
unit_z_2 = UnitZ(Factor=number_slider)
move = Move(Geometry=curve, Motion=unit_z)  # -> Geometry, Transform
extrude = Extrude(Base=move.Geometry, Direction=unit_z_2)
cap_holes = CapHoles(Brep=extrude)

number_slider_2 = Slider(5.42, range=0..10)

unit_y = UnitY(Factor=number_slider_2)
unit_x = UnitX(Factor=number_slider_2)
negative = Negative(Value=unit_x)
negative_2 = Negative(Value=unit_y)
merge = Merge(Data1="0,0,0", Data2=unit_y, Data3=negative_2, Data4=unit_x, Data5=negative)

panel = Panel(merge)
list_length = ListLength(List=merge)
subtraction = Subtraction(A=list_length, B="1")

list_length_2 = ListLength(List=move.Geometry)
construct_domain = ConstructDomain(DomainStart=0, DomainEnd=subtraction)
random = Random(Range=construct_domain, Number=list_length_2, Seed=Slider(364, range=0..1000), Integers=True)
list_item = ListItem(List=merge, Index=random, Wrap=False)

panel_2 = Panel(random)
panel_3 = Panel(list_item)
move_2 = Move(Geometry=cap_holes, Motion=list_item)  # -> Geometry, Transform
