# Grasshopper definition voronoi_example_01.gh (Grasshopper 1.0.7)

plane_surface = PlaneSurface(Plane=PlaneXY(0, 0, 0), XSize=Domain(-10, 10), YSize=Domain(-10, 10))

surface = Surface(plane_surface)
populate_geometry = PopulateGeometry(Geometry=surface, Count=Slider(200, range=0..200), Seed=Slider(82, range=0..200))

curve = Curve(surface)
voronoi = Voronoi(Points=populate_geometry, Boundary=curve, BruteForceOverride=False)

area = Area(Geometry=voronoi)  # -> Area, Centroid
scale = Scale(Geometry=voronoi, Center=area.Centroid, Factor=Slider(0.41, range=0..1))  # -> Geometry, Transform
fillet_distance = FilletDistance(Curve=scale.Geometry, Distance=Slider(0.5, range=0..1))

curve_2 = Curve(<curve referenced from the Rhino model>)
curve_closest_point = CurveClosestPoint(Point=area.Centroid, Curve=curve_2)  # -> Point, Parameter, Distance
bounds = Bounds(Numbers=curve_closest_point.Distance)
construct_domain = ConstructDomain(DomainStart=Slider(6.08, range=0..10), DomainEnd=Slider(0.01, range=0..1))
remap_numbers = RemapNumbers(Value=curve_closest_point.Distance, Source=bounds, Target=construct_domain)  # -> Mapped, Clipped

panel = Panel(voronoi)
panel_2 = Panel(scale.Geometry)
graft_tree = GraftTree(Tree=voronoi, IncludeEmptyLists=True, IncludeNullItems=True)
graft_tree_2 = GraftTree(Tree=fillet_distance, IncludeEmptyLists=True, IncludeNullItems=True)
panel_3 = Panel(fillet_distance)
panel_4 = Panel(graft_tree)
panel_5 = Panel(graft_tree_2)
merge = Merge(Data1=graft_tree, Data2=graft_tree_2)
panel_6 = Panel(merge)
boundary_surfaces = BoundarySurfaces(Edges=merge)  # -> flatten(Surfaces)
unit_z = UnitZ(Factor=remap_numbers.Mapped)
panel_7 = Panel(unit_z)
extrude = Extrude(Base=boundary_surfaces, Direction=unit_z)
panel_8 = Panel(boundary_surfaces)
create_material = CreateMaterial(
    Diffuse=ColourSwatch(SwatchColor=RGB(47, 131, 135)),
    Specular=RGB(255, 255, 255),
    Emission=RGB(0, 0, 0),
    Transparency=0,
    Shine=0)
custom_preview = CustomPreview(Geometry=extrude, Material=create_material)
