# Grasshopper definition brise_parametrico_2021.gh (Grasshopper 1.0.7)

number_slider = Slider(9, range=1..20)
curve = Curve(<curve referenced from the Rhino model>)

# ---- group: Eixos dos montantes
unit_z = UnitZ(Factor=Slider(12.53, range=1..20))
divide_curve = DivideCurve(Curve=curve, Count=number_slider, Kinks=False)  # -> Points, Tangents, Parameters
move = Move(Geometry=divide_curve.Points, Motion=unit_z)  # -> Geometry, Transform
line = Line(StartPoint=divide_curve.Points, EndPoint=move.Geometry)

# ----
panel = Panel(divide_curve.Points)
panel_2 = Panel(move.Geometry)
panel_3 = Panel(line)
number_slider_2 = Slider(27, range=0..100)

# ---- group: Start Points
cull_index = CullIndex(List=line, Indices=number_slider, Wrap=True)
divide_curve_2 = DivideCurve(Curve=cull_index, Count=number_slider_2, Kinks=False)  # -> Points, Tangents, Parameters

# ---- group: End Points
shift_list = ShiftList(List=line, Shift=1, Wrap=Toggle(False))
divide_curve_3 = DivideCurve(Curve=shift_list, Count=number_slider_2, Kinks=False)  # -> Points, Tangents, Parameters

# ----
panel_4 = Panel(cull_index)
panel_5 = Panel(shift_list)
panel_6 = Panel(divide_curve_2.Points)

# ---- group: Eixos das Aletas
line_2 = Line(StartPoint=divide_curve_2.Points, EndPoint=divide_curve_3.Points)

# ----
panel_7 = Panel(divide_curve_3.Points)
panel_8 = Panel(line_2)

# ---- group: Planos das Aletas
construct_plane = ConstructPlane(Origin=divide_curve_2.Points, XAxis=line_2, YAxis=unit_z)
deconstruct_plane = DeconstructPlane(Plane=construct_plane)  # -> Origin, XAxis, YAxis, ZAxis
construct_plane_2 = ConstructPlane(Origin=deconstruct_plane.Origin, XAxis=deconstruct_plane.ZAxis, YAxis=deconstruct_plane.YAxis)

# ----
panel_9 = Panel(construct_plane)
cluster = Cluster(plane=construct_plane_2, angle=Slider(50, range=0..360), A=Slider(0.4, range=0..3), A_2=Slider(0.06, range=0..5))
extrude_along = ExtrudeAlong(Base=cluster, Curve=line_2)

# ==== cluster Cluster
plane = ClusterInput()
angle = ClusterInput()
A = ClusterInput()
A_2 = ClusterInput()
rotate_plane = RotatePlane(Plane=plane, Angle=degrees(angle))
division = Division(A=A, B="2")
division_2 = Division(A=A_2, B="2")
negative = Negative(Value=division)
negative_2 = Negative(Value=division_2)
construct_domain = ConstructDomain(DomainStart=negative_2, DomainEnd=division_2)
construct_domain_2 = ConstructDomain(DomainStart=negative, DomainEnd=division)
rectangle = Rectangle(Plane=rotate_plane, XSize=construct_domain_2, YSize=construct_domain, Radius=0)  # -> Rectangle, Length
boundary_surfaces = BoundarySurfaces(Edges=rectangle.Rectangle)
surfaces = ClusterOutput(boundary_surfaces)
