# Grasshopper definition brise_parametrico_2021b.gh (Grasshopper 1.0.7)

curve = Curve(<curve referenced from the Rhino model>)
panel = Panel(curve)

# ---- group: Eixos dos montantes
unit_z = UnitZ(Factor=Slider(12.53, range=1..20))
divide_curve = DivideCurve(Curve=curve, Count=Slider(5, range=1..20), Kinks=False)  # -> Points, Tangents, Parameters
move = Move(Geometry=divide_curve.Points, Motion=unit_z)  # -> Geometry, Transform
line = Line(StartPoint=divide_curve.Points, EndPoint=move.Geometry)

# ----
panel_2 = Panel(divide_curve.Points)

# ---- group: Montantes
construct_plane = ConstructPlane(Origin=divide_curve.Points, XAxis=divide_curve.Tangents, YAxis=Vector(0, 1, 0))
superficie_retagular_centralizada = SuperficieRetagularCentralizada(plane=construct_plane, angle="0", x_dimension=Slider(0.5, range=0..1), y_dimension=Slider(0.5, range=0..1))  # -> surfaces, perimeter
extrude_along = ExtrudeAlong(Base=superficie_retagular_centralizada.surfaces, Curve=line)

# ----
panel_3 = Panel(divide_curve.Tangents)
panel_4 = Panel(move.Geometry)
panel_5 = Panel(line)

# ---- group: Editando listas dos eixos dos montantes
closed = Closed(Curve=curve)  # -> Closed, Periodic
shift_list = ShiftList(List=line, Shift=1, Wrap=closed.Closed)
shortest_list = ShortestList(ListA=line, ListB=shift_list, TrimMode=2)  # -> ListA, ListB

# ----
panel_6 = Panel(shortest_list.ListA)
panel_7 = Panel(shortest_list.ListB)
number_slider = Slider(13, range=0..100)
panel_8 = Panel(shift_list)

# ---- group: Start Point
divide_curve_2 = DivideCurve(Curve=shortest_list.ListA, Count=number_slider, Kinks=False)  # -> Points, Tangents, Parameters

# ---- group: End point
divide_curve_3 = DivideCurve(Curve=shortest_list.ListB, Count=number_slider, Kinks=False)  # -> Points, Tangents, Parameters

# ----
panel_9 = Panel(divide_curve_2.Points)

# ---- group: Eixos das Aletas
line_2 = Line(StartPoint=divide_curve_2.Points, EndPoint=divide_curve_3.Points)

# ----
panel_10 = Panel(line_2)
end_points = EndPoints(Curve=line_2)  # -> Start, End
panel_11 = Panel(divide_curve_3.Points)
panel_12 = Panel(end_points.Start)

# ---- group: Planos das Aletas
construct_plane_2 = ConstructPlane(Origin=divide_curve_2.Points, XAxis=line_2, YAxis=unit_z)
deconstruct_plane = DeconstructPlane(Plane=construct_plane_2)  # -> Origin, XAxis, YAxis, ZAxis
construct_plane_3 = ConstructPlane(Origin=deconstruct_plane.Origin, XAxis=deconstruct_plane.ZAxis, YAxis=deconstruct_plane.YAxis)

# ----
panel_13 = Panel(end_points.End)
panel_14 = Panel(construct_plane_2)
superficie_retagular_centralizada_2 = SuperficieRetagularCentralizada(
    plane=construct_plane_3,
    angle=Slider(50, range=0..360),
    x_dimension=Slider(0.4, range=0..3),
    y_dimension=Slider(0.06, range=0..5))  # -> surfaces, perimeter
extrude_along_2 = ExtrudeAlong(Base=superficie_retagular_centralizada_2.surfaces, Curve=line_2)

# ==== cluster SuperficieRetagularCentralizada: Cria uma superficie retangular centralizada em um plano
y_dimension = ClusterInput()  # y dimension of the surface
x_dimension = ClusterInput()  # x dimension of the surface
plane = ClusterInput()
angle = ClusterInput()
rotate_plane = RotatePlane(Plane=plane, Angle=degrees(angle))
division = Division(A=x_dimension, B="2")
division_2 = Division(A=y_dimension, B="2")
negative = Negative(Value=division)
negative_2 = Negative(Value=division_2)
construct_domain = ConstructDomain(DomainStart=negative_2, DomainEnd=division_2)
construct_domain_2 = ConstructDomain(DomainStart=negative, DomainEnd=division)
rectangle = Rectangle(Plane=rotate_plane, XSize=construct_domain_2, YSize=construct_domain, Radius=0)  # -> Rectangle, Length
boundary_surfaces = BoundarySurfaces(Edges=rectangle.Rectangle)
surfaces = ClusterOutput(boundary_surfaces)
perimeter = ClusterOutput(rectangle.Length)  # perimeter of the surface
