# Grasshopper definition CLUSTER_EXAMPLE.gh (Grasshopper 1.0.8)

xy_plane = XYPlane(Origin=Point(0, 0, 0))
division = Division(A=Slider(0.4, range=0..1), B="2")
division_2 = Division(A=Slider(0.2, range=0..1), B="2")
negative = Negative(Value=division)
negative_2 = Negative(Value=division_2)
rotate_plane = RotatePlane(Plane=xy_plane, Angle=degrees(Slider(0, range=0..360)))
construct_domain = ConstructDomain(DomainStart=negative, DomainEnd=division)
construct_domain_2 = ConstructDomain(DomainStart=negative_2, DomainEnd=division_2)
rectangle = Rectangle(Plane=rotate_plane, XSize=construct_domain_2, YSize=construct_domain, Radius=0)  # -> Rectangle, Length
boundary_surfaces = BoundarySurfaces(Edges=rectangle.Rectangle)
surface = Surface(boundary_surfaces)
