# Grasshopper definition list_handling.gh (Grasshopper 1.0.7)

curve = Curve()
construct_domain = ConstructDomain(DomainStart=0, DomainEnd=1)
panel = Panel("""a
b
c
d
e
f""")
divide_curve = DivideCurve(Curve=curve, Count=10, Kinks=False)  # -> Points, Tangents, Parameters
bounds = Bounds()
series = Series(Start=Slider(0, range=-10..10), Step=Slider(0.5, range=-10..10), Count=Slider(7, range=1..20))
range = Range(Domain=Domain(0, 1), Steps=10)
random = Random(Range=Domain(0, 1), Number=1, Seed=2)
construct_point = ConstructPoint(XCoordinate=0, YCoordinate=0, ZCoordinate=0)
remap_numbers = RemapNumbers(Source=Domain(0, 1), Target=Domain(0, 1))  # -> Mapped, Clipped
weave = Weave(Pattern=[0, 1], NullGaps=False)
tree_branch = TreeBranch(MaintainPaths=True)
list_length = ListLength()
split_list = SplitList()  # -> ListA, ListB
partition_list = PartitionList(Size=[3, 2])
replace_items = ReplaceItems(Wrap=False)
cull_index = CullIndex(Wrap=True)
flatten_tree = FlattenTree(Path="{0}")
reverse_list = ReverseList()
list_item = ListItem(Index=0, Wrap=True)
suirify = Suirify()
shift = ShiftList(Shift=1, Wrap=True)
cross_reference = CrossReference(CrossMode=1)  # -> ListListA, ListListB
longest_list = LongestList(PaddingMode=2)  # -> ListListA, ListListB
shortest_list = ShortestList(TrimMode=2)  # -> ListListA, ListListB
concatenate = Concatenate()
line = Line()
