# Grasshopper definition METABALL_fernando.gh (Grasshopper 1.0.8)
# plug-ins: MarchingCubes

# ---- group: Gerando metaballs
curve = Curve([<curve referenced from the Rhino model> x2])
gene_pool = GenePool(Decimals=2, Maximum=100, Minimum=10, Value=[19.12, 82.74, 28.99, 58.19])
point = Point([Point(1.250224794, 7.850785648, 0), Point(5.649381645, 70.31640273, 27.96002269), Point(41.50475063, 117.6126304, 0), Point(71.0343809, 26.83193959, 0)])
point_charge = PointCharge(Point=point, Radius=gene_pool, ChargeStrength=Slider(1, range=0..1))
curve_charge = CurveCharge(Curve=curve, Radius=Slider(20.4, range=0..100), ChargeStrengths=Slider(1, range=0..1))
cocoon = Cocoon(
    Charges=[point_charge, curve_charge],
    Iso=Slider(0.3, range=0..1),
    CellSize=Slider(10.34, range=2..100),
    Execute=Toggle(True),
    Simple=False)  # -> Mesh, RefinementData

# ---- group: Redesenhando a malha (mudanças podem travar o código)
number_slider = Slider(2, range=0..5)
refine = Refine(
    RefinementData=cocoon.RefinementData,
    Samples=number_slider,
    SampleSize=Slider(0.2, range=0..100),
    SampleTolerance=Slider(1, range=0..1),
    LaplacianSmoothing=number_slider,
    ValencePasses=number_slider,
    SubD="0",
    Execute=Toggle(True))

# ---- group: Gerando montantes
deconstruct_mesh = DeconstructMesh(Mesh=refine)  # -> Vertices, Faces, Colours, Normals
deconstruct_face = DeconstructFace(Face=deconstruct_mesh.Faces)  # -> CornerA, CornerB, CornerC, CornerD
merge = Merge(Data1=graft(deconstruct_face.CornerA), Data2=graft(deconstruct_face.CornerB), Data3=graft(deconstruct_face.CornerC))
list_item = ListItem(List=deconstruct_mesh.Vertices, Index=merge, Wrap=True)
panel = Panel(merge)
polyline = PolyLine(Vertices=list_item, Closed=Toggle(True))
boundary_surfaces = BoundarySurfaces(Edges=polyline)
area = Area(Geometry=polyline)  # -> Area, Centroid
mesh_brep = MeshBrep(
    Brep=boundary_surfaces,
    Settings={GridMaxCount=0, GridMinCount=16, JaggedSeams=False, MaxEdgeLength=0, MinEdgeLength=0.0001, MinTolerance=0, Refine=True, RefineAngle=0, RelativeTolerance=0.65, SimplePlanes=True, Tolerance=0})
scale = Scale(Geometry=polyline, Center=area.Centroid, Factor=0.5)  # -> Geometry, Transform
face_normals = FaceNormals(Mesh=mesh_brep)  # -> Centers, Normals
merge_2 = Merge(Data1=polyline, Data2=scale.Geometry)
amplitude = Amplitude(Vector=face_normals.Normals, Amplitude=Slider(0.05, range=0..1))
boundary_surfaces_2 = BoundarySurfaces(Edges=merge_2)
extrude = Extrude(Base=boundary_surfaces_2, Direction=amplitude)

# ---- group: Checando o númerro de vertices (quanto mais vertices, maior a chance de travar)
list_length = ListLength(List=deconstruct_mesh.Vertices)
panel_2 = Panel(list_length)

# ----
panel_3 = Panel(list_item)
panel_4 = Panel(merge_2)

# ---- group: paineis
boundary_surfaces_3 = BoundarySurfaces(Edges=polyline)
