# Grasshopper definition trelica_espacial.gh (Grasshopper 1.0.7)

u_count = Slider(10, range=0..100)
v_count = Slider(10, range=0..100)

surface = Surface(<surface referenced from the Rhino model>)

# ---- group: Dividindo superfícies
divide_domain² = DivideDomain²(Domain=surface, UCount=u_count, VCount=v_count)
divide_surface = DivideSurface(Surface=surface, UCount=u_count, VCount=v_count)  # -> Points, Normals, Parameters
isotrim = Isotrim(Surface=surface, Domain=divide_domain²)
deconstruct_brep = DeconstructBrep(Brep=isotrim)  # -> Faces, Edges, Vertices

# ----
evaluate_surface = EvaluateSurface(Surface=reparameterize(deconstruct_brep.Faces), Point=".5,.5")  # -> Point, Normal, UDirection, VDirection, Frame
amplitude = Amplitude(Vector=evaluate_surface.Normal, Amplitude=Slider(1.8, range=0..10))
negative = Negative(Value=amplitude)
move = Move(Geometry=evaluate_surface.Point, Motion=negative)  # -> Geometry, Transform

partition_list = PartitionList(List=flatten(move.Geometry), Size=v_count)
flip_matrix = FlipMatrix(Data=divide_surface.Points)
flip_matrix_2 = FlipMatrix(Data=partition_list)

polyline = PolyLine(Vertices=flip_matrix, Closed=False)
polyline_2 = PolyLine(Vertices=divide_surface.Points, Closed=False)
polyline_3 = PolyLine(Vertices=flip_matrix_2, Closed=False)
polyline_4 = PolyLine(Vertices=partition_list, Closed=False)
line = Line(StartPoint=deconstruct_brep.Vertices, EndPoint=move.Geometry)

merge = Merge(Data1=polyline_2, Data2=polyline_3, Data3=polyline_4, Data4=polyline, Data5=line)

# ---- group: BAKE
pipe = Pipe(Curve=merge, Radius=Slider(0.095, range=0..1), Caps=Slider(1, range=0..2))
