# Grasshopper definition trelica_final.gh (Grasshopper 1.0.8)

# ---- group: Entradas
number_slider = Slider(10, range=0..10)
number_slider_2 = Slider(0.34, range=0..1)
number_slider_3 = Slider(0.73, range=0..1)
number_slider_4 = Slider(9, range=0..100)
curve = Curve(<curve referenced from the Rhino model>)

# ---- group: Criando banzo inferior
unit_z = UnitZ(Factor=number_slider)
negative = Negative(Value=unit_z)
move = Move(Geometry=curve, Motion=negative)  # -> Geometry, Transform

# ---- group: Dividindo banzos em partes iguais
divide_curve = DivideCurve(Curve=move.Geometry, Count=number_slider_4, Kinks=False)  # -> Points, Tangents, Parameters
divide_curve_2 = DivideCurve(Curve=curve, Count=number_slider_4, Kinks=False)  # -> Points, Tangents, Parameters

# ---- group: Manipulando listas para criação das diagonais
dispatch = Dispatch(List=divide_curve.Points, DispatchPattern=[True, False])  # -> ListA, ListB
dispatch_2 = Dispatch(List=divide_curve_2.Points, DispatchPattern=[True, False])  # -> ListA, ListB
weave = Weave(Pattern=[0, 1], Stream0=dispatch_2.ListA, Stream1=dispatch.ListB, NullGaps=False)
weave_2 = Weave(Pattern=[0, 1], Stream0=dispatch.ListA, Stream1=dispatch_2.ListB, NullGaps=False)

# ----
polyline = PolyLine(Vertices=weave_2, Closed=False)
polyline_2 = PolyLine(Vertices=weave, Closed=False)
line = Line(StartPoint=divide_curve_2.Points, EndPoint=divide_curve.Points)
explode = Explode(Curve=polyline_2, Recursive=True)  # -> Segments, Vertices
explode_2 = Explode(Curve=polyline, Recursive=True)  # -> Segments, Vertices

# ---- group: Bake
pipe = Pipe(Curve=[move.Geometry, curve], Radius=number_slider_3, Caps=0)
pipe_2 = Pipe(Curve=explode_2.Segments, Radius=number_slider_2, Caps=0)
pipe_3 = Pipe(Curve=line, Radius=number_slider_2, Caps=0)
pipe_4 = Pipe(Curve=explode.Segments, Radius=number_slider_2, Caps=0)
