# Grasshopper definition paineis_triangulares_aleatórios.gh (Grasshopper 1.0.8)

xz_plane = XZPlane(Origin=Point(0, 0, 0))
plane_surface = PlaneSurface(Plane=xz_plane, XSize=Domain(-10, 10), YSize=Domain(-10, 10))
surface = Surface(plane_surface)
divide_domain² = DivideDomain²(Domain=surface, UCount=Slider(14, range=0..100), VCount=Slider(12, range=0..100))
isotrim = Isotrim(Surface=surface, Domain=divide_domain²)
area = Area(Geometry=isotrim)  # -> Area, Centroid
evaluate_surface = EvaluateSurface(Surface=isotrim, Point=area.Centroid)  # -> Point, Normal, UDirection, VDirection, Frame
curve = Curve(isotrim)
negative = Negative(Value=Slider(0.1, range=0..1))
offset_curve = OffsetCurve(Curve=curve, Distance=negative, Plane=evaluate_surface.Frame, Corners=1)
panel = Panel(curve)
explode = Explode(Curve=offset_curve, Recursive=True)  # -> Segments, Vertices
panel_2 = Panel(explode.Vertices)
list_length = ListLength(List=flatten(offset_curve))
cull_index = CullIndex(List=explode.Vertices, Indices="0", Wrap=True)
panel_3 = Panel(cull_index)
random = Random(Range="3", Number=list_length, Seed=Slider(300, range=0..1000), Integers=True)  # -> graft(Random)
panel_4 = Panel(random)
cull_index_2 = CullIndex(List=cull_index, Indices=random, Wrap=True)
polyline = PolyLine(Vertices=cull_index_2, Closed=Toggle(True))
panel_5 = Panel(cull_index_2)
merge = Merge(Data1=simplify(graft(curve)), Data2=simplify(polyline))
panel_6 = Panel(merge)
boundary_surfaces = BoundarySurfaces(Edges=merge)
amplitude = Amplitude(Vector=evaluate_surface.Normal, Amplitude=Slider(2, range=0..10))
extrude = Extrude(Base=boundary_surfaces, Direction=amplitude)
